# Grasshopper definition GenerativeDesign_WS_001.gh (Grasshopper 1.0.7)
# plug-ins: Bifocals

B = Slider(98, range=1..110)
# Parametric Model capable of taking multiple states
# 
# Way to evaluate different states fo model based on a given metric, i.e. areas
# 
# Basic Computational Analysis, browse, sort and filter (custom tool)
# 
# Use the worfflow
# 
# Look at Evolutionary opperations
# Create a simple parametric model
number_slider = Slider(23, range=0..100)
number_slider_2 = Slider(3, range=0..10)
B_2 = Slider(59, range=1..110)
B_3 = Slider(84, range=1..110)
B_4 = Slider(61, range=1..110)
B_5 = Slider(58, range=1..110)
B_6 = Slider(88, range=1..110)
B_7 = Slider(69, range=1..110)
B_8 = Slider(62, range=1..110)
B_9 = Slider(30, range=1..110)
floor_height = Slider(4.5, range=0..10)
square = Square(Plane=PlaneXY(0, 0, 0), Size=number_slider, ExtentX=number_slider_2, ExtentY=number_slider_2)  # -> Cells, Points
merge = Merge(Data1=B_2, Data2=B_6, Data3=B_7, Data4=B_8, Data6=B_3, Data7=B_4, Data8=B_5, Data9=B_9)

sort_list = SortList(Keys=merge)  # -> reverse(Keys), ValuesA
split_list = SplitList(List=merge, Index=Slider(4, range=0..10))  # -> ListA, ListB
list_item = ListItem(List=sort_list.Keys, Index=0, Wrap=True)
merge_2 = Merge(Data1=flatten(split_list.ListA), Data2=flatten(list_item), Data3=flatten(split_list.ListB))
panel = Panel(merge_2)

multiplication = Multiplication(A=floor_height, B=merge_2)
unit_z = UnitZ(Factor=multiplication)

# ----
# Create a simple parametric model
# AREA SLOW!!!
curve = Curve(flatten(square.Cells))
vector = Vector(unit_z)
extrude = Extrude(Base=curve, Direction=vector)
cap_holes = CapHoles(Brep=extrude)

geometry = Geometry(cap_holes)
geometry_2 = Geometry(geometry)
number = Number(floor_height)
contour = Contour(Shape=geometry_2, Point=Point(0, 0, 0), Direction=Vector(0, 0, 1), Distance=number)  # disabled

# ----
# AREA FAST!!!
mass_addition = MassAddition(Input=merge_2)  # -> Result, PartialResults
number_2 = Number(number_slider)
multiplication_2 = Multiplication(A=number_2, B=number_2, C=mass_addition.Result)
integer = Integer(multiplication_2)

panel_2 = Panel(integer)
curve_2 = Curve(contour)
area = Area(Geometry=curve_2)  # -> Area, Centroid
mass_addition_2 = MassAddition(Input=flatten(area.Area))  # -> Result, PartialResults
panel_3 = Panel(mass_addition_2.Result)

# ----
# Build a Sun System
# i.e. Ladybug
number_slider_3 = Slider(550, range=0..1000)
sphere = Sphere(Base=PlaneXY(0, 0, 0), Radius=number_slider_3)
brep_plane = BrepPlane(Brep=sphere, Plane=PlaneXY(0, 0, 0))  # -> Curves, Points
surface_split = SurfaceSplit(Surface=sphere, Curves=brep_plane.Curves)
construct_point = ConstructPoint(XCoordinate=Slider(0.6, range=0..1), YCoordinate=Slider(0.9, range=0.5..1), ZCoordinate=0)
split_brep = SplitBrep(Brep=sphere, Cutter=brep_plane.Curves)  # disabled
list_item_2 = ListItem(List=surface_split, Index=0, Wrap=True)
evaluate_surface = EvaluateSurface(Surface=reparameterize(list_item_2), Point=construct_point)  # -> Point, Normal, UDirection, VDirection, Frame
iso_curve = IsoCurve(Surface=reparameterize(list_item_2), UVPoint=construct_point)  # -> UIsocurve, VIsocurve
point = Point(evaluate_surface.Point)
vector_2 = Vector(evaluate_surface.Point)
reverse = Reverse(Vector=vector_2)
amplitude = Amplitude(Vector=reverse, Amplitude=Slider(287, range=0..1000))
vector_display_ex = VectorDisplayEx(Point=point, Vector=amplitude, Colour=ColourSwatch(SwatchColor=RGB(0, 255, 255)), Width=2)
vector_3 = Vector(amplitude)

mesh_shadow = MeshShadow(Mesh=geometry, Light=vector_3, Plane=PlaneXY(0, 0, 0))
region_union = RegionUnion(Curves=flatten(mesh_shadow))
park = Curve(<curve referenced from the Rhino model>)
neighbor = Curve(<curve referenced from the Rhino model>)
curve_3 = Curve(region_union)
area_2 = Area(Geometry=curve_3)  # -> Area, Centroid
integer_2 = Integer(area_2.Area)
panel_4 = Panel(integer_2)
