# Grasshopper definition GenerativeDesign_WS_001B.gh (Grasshopper 1.0.7)
# plug-ins: Bifocals

# ----
# Build a Sun System
# i.e. Ladybug
number_slider = Slider(550, range=0..1000)  # disabled
number_slider_2 = Slider(0.6, range=0..1)  # disabled
number_slider_3 = Slider(0.9, range=0.5..1)  # disabled
sphere = Sphere(Base=PlaneXY(0, 0, 0), Radius=number_slider)  # disabled
brep_plane = BrepPlane(Brep=sphere, Plane=PlaneXY(0, 0, 0))  # -> Curves, Points; disabled
surface_split = SurfaceSplit(Surface=sphere, Curves=brep_plane.Curves)  # disabled
construct_point = ConstructPoint(XCoordinate=number_slider_2, YCoordinate=number_slider_3, ZCoordinate=0)  # disabled
split_brep = SplitBrep(Brep=sphere, Cutter=brep_plane.Curves)  # disabled
list_item = ListItem(List=surface_split, Index=0, Wrap=True)  # disabled
evaluate_surface = EvaluateSurface(Surface=reparameterize(list_item), Point=construct_point)  # -> Point, Normal, UDirection, VDirection, Frame; disabled
iso_curve = IsoCurve(Surface=reparameterize(list_item), UVPoint=construct_point)  # -> UIsocurve, VIsocurve; disabled
number_slider_4 = Slider(287, range=0..1000)  # disabled
point = Point(evaluate_surface.Point)  # disabled
vector = Vector(evaluate_surface.Point)  # disabled
reverse = Reverse(Vector=vector)  # disabled
amplitude = Amplitude(Vector=reverse, Amplitude=number_slider_4)  # disabled
colour_swatch = ColourSwatch(SwatchColor=RGB(0, 255, 255))  # disabled
vector_display_ex = VectorDisplayEx(Point=point, Vector=amplitude, Colour=colour_swatch, Width=2)  # disabled
vector_2 = Vector(amplitude)  # disabled

B = Slider(98, range=1..110)  # disabled
B_2 = Slider(96, range=1..110)  # disabled
B_3 = Slider(59, range=1..110)  # disabled
B_4 = Slider(72, range=1..110)  # disabled
B_5 = Slider(60, range=1..110)  # disabled
B_6 = Slider(53, range=1..110)  # disabled
B_7 = Slider(88, range=1..110)  # disabled
B_8 = Slider(60, range=1..110)  # disabled
B_9 = Slider(30, range=1..110)  # disabled

# ----
# Parametric Model capable of taking multiple states
# 
# Way to evaluate different states fo model based on a given metric, i.e. areas
# 
# Basic Computational Analysis, browse, sort and filter (custom tool)
# 
# Use the workflow
# 
# Look at Evolutionary opperations
# Create a simple parametric model
# FIX!
number_slider_5 = Slider(23, range=0..100)  # disabled
number_slider_6 = Slider(3, range=0..10)  # disabled
floor_height = Slider(4.5, range=0..10)  # disabled
square = Square(Plane=PlaneXY(0, 0, 0), Size=number_slider_5, ExtentX=number_slider_6, ExtentY=number_slider_6)  # -> Cells, Points; disabled
merge = Merge(Data1=B_3, Data2=B_7, Data3=B_2, Data4=B_8, Data6=B_4, Data7=B_5, Data8=B_6, Data9=B_9)  # disabled
number = Number(floor_height)  # disabled

number_slider_7 = Slider(4, range=0..10)  # disabled
sort_list = SortList(Keys=merge)  # -> reverse(Keys), ValuesValuesA; disabled
split_list = SplitList(List=merge, Index=number_slider_7)  # -> ListA, ListB; disabled
list_item_2 = ListItem(List=sort_list.Keys, Index=0, Wrap=True)  # disabled
merge_2 = Merge(Data1=flatten(split_list.ListA), Data2=flatten(list_item_2), Data3=flatten(split_list.ListB))  # disabled
panel = Panel(merge_2)  # disabled

# ----
# AREA FAST!!!
mass_addition = MassAddition(Input=merge_2)  # -> Result, PartialResults; disabled
number_2 = Number(number_slider_5)  # disabled
multiplication = Multiplication(A=number_2, B=number_2, C=mass_addition.Result)  # disabled
integer = Integer(multiplication)  # disabled

panel_2 = Panel(integer)  # disabled

multiplication_2 = Multiplication(A=floor_height, B=merge_2)  # disabled
unit_z = UnitZ(Factor=multiplication_2)  # disabled

# ----
# Create a simple parametric model
# AREA SLOW!!!
curve = Curve(flatten(square.Cells))  # disabled
vector_3 = Vector(unit_z)  # disabled
extrude = Extrude(Base=curve, Direction=vector_3)  # disabled
cap_holes = CapHoles(Brep=extrude)  # disabled

geometry = Geometry(cap_holes)  # disabled
geometry_2 = Geometry(geometry)  # disabled
contour = Contour(Shape=geometry_2, Point=Point(0, 0, 0), Direction=Vector(0, 0, 1), Distance=number)  # disabled
curve_2 = Curve(contour)  # disabled
area = Area(Geometry=curve_2)  # -> Area, Centroid; disabled
mass_addition_2 = MassAddition(Input=flatten(area.Area))  # -> Result, PartialResults; disabled

panel_3 = Panel(mass_addition_2.Result)  # disabled

# ----
# Shadow Analysis
mesh_shadow = MeshShadow(Mesh=geometry, Light=vector_2, Plane=PlaneXY(0, 0, 0))  # disabled
region_union = RegionUnion(Curves=flatten(mesh_shadow))  # disabled
neighbor = Curve(<curve referenced from the Rhino model>)  # disabled
park = Curve(<curve referenced from the Rhino model>)  # disabled

# ---- group: Shadow
curve_3 = Curve(region_union)  # disabled

# ----
area_2 = Area(Geometry=curve_3)  # -> Area, Centroid; disabled
region_intersection = RegionIntersection(CurvesA=curve_3, CurvesB=neighbor)  # disabled
region_intersection_2 = RegionIntersection(CurvesA=curve_3, CurvesB=park)  # disabled
integer_2 = Integer(area_2.Area)  # disabled
area_3 = Area(Geometry=region_intersection_2)  # -> Area, Centroid; disabled
area_4 = Area(Geometry=region_intersection)  # -> Area, Centroid; disabled

null_item = NullItem(Item=region_intersection)  # -> NullFlags, InvalidFlags, Description; disabled
null_item_2 = NullItem(Item=region_intersection_2)  # -> NullFlags, InvalidFlags, Description; disabled
panel_4 = Panel("0")  # disabled
panel_5 = Panel("0")  # disabled
weave = Weave(Pattern=null_item.NullFlags, Stream0=area_4.Area, Stream1=panel_4, NullGaps=False)  # disabled
weave_2 = Weave(Pattern=null_item_2.NullFlags, Stream0=area_3.Area, Stream1=panel_5, NullGaps=False)  # disabled

integer_3 = Integer(weave)  # disabled
integer_4 = Integer(weave_2)  # disabled

park_shadow = Panel(integer_4)  # disabled
total_shadow_area = Panel(integer_2)  # disabled
neighbor_shadow = Panel(integer_3)  # disabled

B_10 = Slider(98, range=1..110)
B_11 = Slider(96, range=1..110)
B_12 = Slider(59, range=1..110)
B_13 = Slider(88, range=1..110)
B_14 = Slider(60, range=1..110)
B_15 = Slider(72, range=1..110)
B_16 = Slider(60, range=1..110)
B_17 = Slider(53, range=1..110)
B_18 = Slider(30, range=1..110)

# ----
# Parametric Model capable of taking multiple states
# 
# Way to evaluate different states fo model based on a given metric, i.e. areas
# 
# Basic Computational Analysis, browse, sort and filter (custom tool)
# 
# Use the workflow
# 
# Look at Evolutionary operations
# Create a simple parametric model
# FIX!
number_slider_8 = Slider(23, range=0..100)
number_slider_9 = Slider(3, range=0..10)
floor_height_2 = Slider(4.5, range=0..10)
square_2 = Square(Plane=PlaneXY(0, 0, 0), Size=number_slider_8, ExtentX=number_slider_9, ExtentY=number_slider_9)  # -> Cells, Points
merge_3 = Merge(Data1=B_12, Data2=B_13, Data3=B_11, Data4=B_14, Data6=B_15, Data7=B_16, Data8=B_17, Data9=B_18)
curve_4 = Curve(flatten(square_2.Cells))
area_5 = Area(Geometry=curve_4)  # -> Area, Centroid

sort_list_2 = SortList(Keys=merge_3)  # -> reverse(Keys), ValuesValuesA
split_list_2 = SplitList(List=merge_3, Index=Slider(4, range=0..10))  # -> ListA, ListB
list_item_3 = ListItem(List=sort_list_2.Keys, Index=0, Wrap=True)
merge_4 = Merge(Data1=flatten(split_list_2.ListA), Data2=flatten(list_item_3), Data3=flatten(split_list_2.ListB))
panel_6 = Panel(merge_4)

# ----
# AREA FAST!!!
mass_addition_3 = MassAddition(Input=merge_4)  # -> Result, PartialResults
number_3 = Number(number_slider_8)
multiplication_3 = Multiplication(A=number_3, B=number_3, C=mass_addition_3.Result)
integer_5 = Integer(multiplication_3)

panel_7 = Panel(integer_5)

multiplication_4 = Multiplication(A=floor_height_2, B=merge_4)
unit_z_2 = UnitZ(Factor=multiplication_4)
vector_4 = Vector(unit_z_2)
extrude_2 = Extrude(Base=curve_4, Direction=vector_4)
cap_holes_2 = CapHoles(Brep=extrude_2)
geometry_3 = Geometry(cap_holes_2)

# ----
# Create a simple parametric model
# AREA SLOW!!!
number_4 = Number(floor_height_2)
geometry_4 = Geometry(geometry_3)
contour_2 = Contour(Shape=geometry_4, Point=Point(0, 0, 0), Direction=Vector(0, 0, 1), Distance=number_4)  # disabled
curve_5 = Curve(contour_2)
area_6 = Area(Geometry=curve_5)  # -> Area, Centroid
mass_addition_4 = MassAddition(Input=flatten(area_6.Area))  # -> Result, PartialResults

# ----
# Wickerson Custom Jazz
number_slider_10 = Slider(1.46, range=0..2)
volume = Volume(Geometry=geometry_3)  # -> Volume, Centroid
construct_domain = ConstructDomain(DomainStart=Slider(0.47, range=0..2), DomainEnd=number_slider_10)
deconstruct_brep = DeconstructBrep(Brep=geometry_3)  # -> Faces, Edges, Vertices
list_length = ListLength(List=geometry_3)
range = Range(Domain=construct_domain, Steps=expr("x-1", list_length))
list_item_4 = ListItem(List=deconstruct_brep.Faces, Index=Slider(5, range=0..5), Wrap=True)
pi = Pi(Factor=range)
area_7 = Area(Geometry=list_item_4)  # -> Area, Centroid
line = Line(StartPoint=area_5.Centroid, EndPoint=flatten(area_7.Centroid))
rotate_3d = Rotate3D(Geometry=geometry_3, Angle=pi, Center=volume.Centroid, Axis=line)  # -> Geometry, Transform

panel_8 = Panel(mass_addition_4.Result)

# ----
# Build a Sun System
# i.e. Ladybug
number_slider_11 = Slider(550, range=0..1000)
sphere_2 = Sphere(Base=PlaneXY(0, 0, 0), Radius=number_slider_11)
number_slider_12 = Slider(0.62, range=0..1)  # disabled
number_slider_13 = Slider(0.8, range=0.5..1)  # disabled
brep_plane_2 = BrepPlane(Brep=sphere_2, Plane=PlaneXY(0, 0, 0))  # -> Curves, Points
surface_split_2 = SurfaceSplit(Surface=sphere_2, Curves=brep_plane_2.Curves)
construct_point_2 = ConstructPoint(XCoordinate=number_slider_12, YCoordinate=number_slider_13, ZCoordinate=0)  # disabled
split_brep_2 = SplitBrep(Brep=sphere_2, Cutter=brep_plane_2.Curves)  # disabled
list_item_5 = ListItem(List=surface_split_2, Index=Toggle(False), Wrap=True)

# ----
# Wickerson Custom Jazz
md_slider = MDSlider(
    SliderMode=0,
    slider_value=Point(0.7322343035, 0.8077600991, 0.5),
    x_domain=Domain(0, 1),
    y_domain=Domain(0, 1),
    z_domain=Domain(0, 1))
polygon = Polygon(Plane=PlaneXY(0, 0, 0), Radius=Slider(1000, range=100..1000), Segments=6, FilletRadius=0)  # -> Polygon, Length
sphere_3 = Sphere(Base=PlaneXY(0, 0, 0), Radius=Slider(187, range=100..1000))
vector_xyz = VectorXYZ(XComponent=Slider(0.1, range=0..1), YComponent=Slider(0.87, range=0..1), ZComponent=Slider(0.67, range=0..1))  # -> Vector, Length
curve_6 = Curve(polygon.Polygon)

evaluate_surface_2 = EvaluateSurface(Surface=reparameterize(list_item_5), Point=md_slider)  # -> Point, Normal, UDirection, VDirection, Frame
iso_curve_2 = IsoCurve(Surface=reparameterize(list_item_5), UVPoint=md_slider)  # -> UIsocurve, VIsocurve
point_2 = Point(evaluate_surface_2.Point)
vector_5 = Vector(evaluate_surface_2.Point)
reverse_2 = Reverse(Vector=vector_5)
amplitude_2 = Amplitude(Vector=reverse_2, Amplitude=Slider(287, range=0..1000))
vector_display_ex_2 = VectorDisplayEx(Point=point_2, Vector=amplitude_2, Colour=ColourSwatch(SwatchColor=RGB(0, 255, 255)), Width=2)
vector_6 = Vector(amplitude_2)

sphere_4 = Sphere(Base=point_2, Radius=Slider(28, range=0..100))

# ---- group: ObjectB
neighbor_2 = Curve(curve_6)

# ----
# Shadow Analysis
mesh_shadow_2 = MeshShadow(Mesh=rotate_3d.Geometry, Light=vector_6, Plane=PlaneXY(0, 0, 0))
region_union_2 = RegionUnion(Curves=flatten(mesh_shadow_2))

project = Project(Curve=region_union_2, Brep=sphere_3, Direction=vector_xyz.Vector)
curve_7 = Curve(project)
project_2 = Project(Curve=curve_7, Brep=curve_6, Direction=Vector(0, 0, 1))
dispatch = Dispatch(List=project, DispatchPattern=[True, False])  # -> ListA, ListB
region_union_3 = RegionUnion(Curves=project_2)
curve_8 = Curve(dispatch.ListA)
curve_9 = Curve(dispatch.ListB)

# ---- group: ObjectA
park_2 = Curve(region_union_3)

# ---- group: Shadow
curve_10 = Curve(region_union_2)

# ----
area_8 = Area(Geometry=curve_10)  # -> Area, Centroid
region_intersection_3 = RegionIntersection(CurvesA=curve_10, CurvesB=neighbor_2)
region_intersection_4 = RegionIntersection(CurvesA=curve_10, CurvesB=park_2)
integer_6 = Integer(area_8.Area)
area_9 = Area(Geometry=region_intersection_4)  # -> Area, Centroid
area_10 = Area(Geometry=region_intersection_3)  # -> Area, Centroid

null_item_3 = NullItem(Item=region_intersection_3)  # -> NullFlags, InvalidFlags, Description
null_item_4 = NullItem(Item=region_intersection_4)  # -> NullFlags, InvalidFlags, Description
weave_3 = Weave(Pattern=null_item_4.NullFlags, Stream0=area_9.Area, Stream1="0", NullGaps=False)
weave_4 = Weave(Pattern=null_item_3.NullFlags, Stream0=area_10.Area, Stream1="0", NullGaps=False)

integer_7 = Integer(weave_4)
integer_8 = Integer(weave_3)

park_shadow_2 = Panel(integer_8)
total_shadow_area_2 = Panel(integer_6)
neighbor_shadow_2 = Panel(integer_7)

# ----
# Wickerson Custom Jazz
boolean_toggle = BooleanToggle(True)
list_length_2 = ListLength(List=flatten(region_intersection_4))
clean_tree = CleanTree(RemoveNulls=boolean_toggle, RemoveInvalid=boolean_toggle, RemoveEmpty=boolean_toggle, Tree=region_intersection_4)
range_2 = Range(Domain=Slider(77, range=0..100), Steps=expr("x-1", list_length_2))
unit_z_3 = UnitZ(Factor=range_2)
extrude_3 = Extrude(Base=simplify(graft(clean_tree)), Direction=simplify(graft(unit_z_3)))
cap_holes_3 = CapHoles(Brep=extrude_3)
cull_index = CullIndex(List=flatten(cap_holes_3), Indices="0", Wrap=True)
panel_9 = Panel(cull_index)
