# Grasshopper definition GenerativeDesign_WS_002.gh (Grasshopper 1.0.7)
# plug-ins: Bifocals

number_slider = Slider(30, range=0..100)
series = Series(Start=number_slider, Step=number_slider, Count=Slider(3, range=0..10))
# Create a simple parametric model
number_slider_2 = Slider(23, range=0..100)
number_slider_3 = Slider(3, range=0..10)
floor_height = Slider(4.5, range=0..10)
crossref = CrossReference(
    ListA=series,
    ListB=series,
    ListC=series,
    ListD=series,
    ListE=series,
    ListF=series,
    ListG=series,
    ListH=series,
    CrossMode=1)  # -> ListA, ListB, ListC, ListD, ListE, ListF, ListG, ListH
merge = Merge(
    Data1=graft(crossref.ListA),
    Data2=graft(crossref.ListB),
    Data3=graft(crossref.ListC),
    Data4=graft(crossref.ListD),
    Data6=graft(crossref.ListE),
    Data7=graft(crossref.ListF),
    Data8=graft(crossref.ListG),
    Data9=graft(crossref.ListH))
sqgrid = Square(Plane=PlaneXY(0, 0, 0), Size=number_slider_2, ExtentX=number_slider_3, ExtentY=number_slider_3)  # -> Cells, Points
crv = Curve(flatten(sqgrid.Cells))

# ----
# Build a Sun System
# i.e. Ladybug
number_slider_4 = Slider(550, range=0..1000)  # disabled
number_slider_5 = Slider(0.64, range=0..1)  # disabled
number_slider_6 = Slider(0.87, range=0.5..1)  # disabled
sph = Sphere(Base=PlaneXY(0, 0, 0), Radius=number_slider_4)  # disabled
sec = BrepPlane(Brep=sph, Plane=PlaneXY(0, 0, 0))  # -> Curves, Points; disabled
srfsplit = SurfaceSplit(Surface=sph, Curves=sec.Curves)  # disabled
split = SplitBrep(Brep=sph, Cutter=sec.Curves)  # disabled
pt = ConstructPoint(XCoordinate=number_slider_5, YCoordinate=number_slider_6, ZCoordinate=0)  # disabled
item = ListItem(List=srfsplit, Index=0, Wrap=True)  # disabled
evalsrf = EvaluateSurface(Surface=reparameterize(item), Point=pt)  # -> Point, Normal, UDirection, VDirection, Frame; disabled
iso = IsoCurve(Surface=reparameterize(item), UVPoint=pt)  # -> UIsocurve, VIsocurve; disabled
number_slider_7 = Slider(287, range=0..1000)  # disabled
pt_2 = Point(evalsrf.Point)  # disabled
vec = Vector(evalsrf.Point)  # disabled
rev = Reverse(Vector=vec)  # disabled
swatch = ColourSwatch(SwatchColor=RGB(0, 255, 255))  # disabled
amp = Amplitude(Vector=rev, Amplitude=number_slider_7)  # disabled
vdisex = VectorDisplayEx(Point=pt_2, Vector=amp, Colour=swatch, Width=2)  # disabled
vec_2 = Vector(amp)  # disabled

# ----
# Build a Sun System
# i.e. Ladybug
number_slider_8 = Slider(550, range=0..1000)
sph_2 = Sphere(Base=PlaneXY(0, 0, 0), Radius=number_slider_8)
sec_2 = BrepPlane(Brep=sph_2, Plane=PlaneXY(0, 0, 0))  # -> Curves, Points
srfsplit_2 = SurfaceSplit(Surface=sph_2, Curves=sec_2.Curves)
split_2 = SplitBrep(Brep=sph_2, Cutter=sec_2.Curves)
pt_3 = ConstructPoint(XCoordinate=Slider(0.6, range=0..1), YCoordinate=Slider(0.87, range=0.5..1), ZCoordinate=0)
item_2 = ListItem(List=srfsplit_2, Index=0, Wrap=True)
evalsrf_2 = EvaluateSurface(Surface=reparameterize(item_2), Point=pt_3)  # -> Point, Normal, UDirection, VDirection, Frame
iso_2 = IsoCurve(Surface=reparameterize(item_2), UVPoint=pt_3)  # -> UIsocurve, VIsocurve
pt_4 = Point(evalsrf_2.Point)
vec_3 = Vector(evalsrf_2.Point)
rev_2 = Reverse(Vector=vec_3)
amp_2 = Amplitude(Vector=rev_2, Amplitude=Slider(287, range=0..1000))
vdisex_2 = VectorDisplayEx(Point=pt_4, Vector=amp_2, Colour=ColourSwatch(SwatchColor=RGB(0, 255, 255)), Width=2)
vec_4 = Vector(amp_2)

sqgrid_2 = Square(Plane=PlaneXY(0, 0, 0), Size=Slider(300, range=0..1000), ExtentX=Slider(4, range=0..10), ExtentY=Slider(5, range=0..10))  # -> Cells, Points
pt_5 = Point(flatten(sqgrid_2.Points))
panel = Panel("test")
panel_2 = Panel("""Floor Area: 
Shadow Area: 
Park Shadow: 
Neighbor Area: """)
lng = ListLength(List=pt_5)
# Text Labels
number_slider_9 = Slider(8, range=0..10)

# ----
# Parametric Model capable of taking multiple states
# 
# Way to evaluate different states fo model based on a given metric, i.e. areas
# 
# Basic Computational Analysis, browse, sort and filter (custom tool)
# 
# Use the workflow
# 
# Look at Evolutionary opperations
# Create a simple parametric model
B = Slider(59, range=1..110)  # disabled
B_2 = Slider(100, range=1..110)  # disabled
B_3 = Slider(96, range=1..110)  # disabled
B_4 = Slider(60, range=1..110)  # disabled
B_5 = Slider(72, range=1..110)  # disabled
B_6 = Slider(60, range=1..110)  # disabled
B_7 = Slider(53, range=1..110)  # disabled
B_8 = Slider(37, range=1..110)  # disabled
B_9 = Slider(45, range=1..110)  # disabled
B_10 = Slider(53, range=1..110)  # disabled
B_11 = Slider(56, range=1..110)  # disabled
B_12 = Slider(76, range=1..110)  # disabled
B_13 = Slider(87, range=1..110)  # disabled
B_14 = Slider(82, range=1..110)  # disabled
B_15 = Slider(74, range=1..110)  # disabled
B_16 = Slider(67, range=1..110)  # disabled
number_slider_10 = Slider(23, range=0..100)  # disabled
number_slider_11 = Slider(3, range=0..10)  # disabled
floor_height_2 = Slider(4.5, range=0..10)  # disabled
sqgrid_3 = Square(Plane=PlaneXY(0, 0, 0), Size=number_slider_10, ExtentX=number_slider_11, ExtentY=number_slider_11)  # -> Cells, Points; disabled
merge_2 = Merge(
    Data1=graft([B, B_9]),
    Data2=graft([B_2, B_10]),
    Data3=graft([B_3, B_11]),
    Data4=graft([B_4, B_12]),
    Data6=graft([B_5, B_13]),
    Data7=graft([B_6, B_14]),
    Data8=graft([B_7, B_15]),
    Data9=graft([B_8, B_16]))  # disabled

number_slider_12 = Slider(4, range=0..10)  # disabled
sort = SortList(Keys=merge_2)  # -> reverse(Keys), ValuesA; disabled
split_3 = SplitList(List=merge_2, Index=number_slider_12)  # -> ListA, ListB; disabled
item_3 = ListItem(List=sort.Keys, Index=0, Wrap=True)  # disabled
merge_3 = Merge(Data1=simplify(split_3.ListA), Data2=simplify(item_3), Data3=simplify(split_3.ListB))  # disabled
panel_3 = Panel(merge_3)  # disabled

# ----
# AREA FAST!!!
ma = MassAddition(Input=merge_3)  # -> Result, PartialResults; disabled
num = Number(number_slider_10)  # disabled
multiplication = Multiplication(A=num, B=num, C=ma.Result)  # disabled
int = Integer(multiplication)  # disabled

multiplication_2 = Multiplication(A=floor_height_2, B=merge_3)  # disabled
Z = UnitZ(Factor=multiplication_2)  # disabled
floor_area = Panel(int)  # disabled

# ----
# Create a simple parametric model
# AREA SLOW!!!
crv_2 = Curve(flatten(sqgrid_3.Cells))  # disabled
vec_5 = Vector(Z)  # disabled
extr = Extrude(Base=crv_2, Direction=vec_5)  # disabled
cap = CapHoles(Brep=extr)  # disabled

sort_2 = SortList(Keys=merge)  # -> reverse(Keys), ValuesA
split_4 = SplitList(List=merge, Index=Slider(4, range=0..10))  # -> ListA, ListB
item_4 = ListItem(List=sort_2.Keys, Index=0, Wrap=True)
merge_4 = Merge(Data1=simplify(split_4.ListA), Data2=simplify(item_4), Data3=simplify(split_4.ListB))
panel_4 = Panel(merge_4)

# ----
# AREA FAST!!!
ma_2 = MassAddition(Input=merge_4)  # -> Result, PartialResults
num_2 = Number(number_slider_2)
multiplication_3 = Multiplication(A=num_2, B=num_2, C=ma_2.Result)
int_2 = Integer(multiplication_3)

# ----
# Create a simple parametric model
viewer = ParamViewer(int_2)

# ----
# Really Nice and Smart
number_slider_13 = Slider(357489, range=0..1000000)
join = TextJoin(Text=merge_4, Join="-")
larger = LargerThan(FirstNumber=int_2, SecondNumber=number_slider_13)  # -> LargerThan, OrEqualTo
cull = CullPattern(List=join, CullPattern=larger.LargerThan)
panel_5 = Panel(larger.LargerThan)
split_5 = TextSplit(Text=cull, Separators="-")
clean = CleanTree(RemoveNulls=True, RemoveInvalid=True, RemoveEmpty=True, Tree=split_5)
heights = Integer(clean)
viewer_2 = ParamViewer(heights)

multiplication_4 = Multiplication(A=floor_height, B=heights)
Z_2 = UnitZ(Factor=multiplication_4)

# ----
# Fast Generating Mesh Model
int_3 = Integer(number_slider_2)
division = Division(A=int_3, B="2")
area = Area(Geometry=crv)  # -> Area, Centroid
dom = ConstructDomain(DomainStart=expr("-x", division), DomainEnd=division)
number_slider_14 = Slider(1, range=0..1)
box = DomainBox(Base=area.Centroid, X=dom, Y=dom, Z=multiplication_4)
mbox = MeshBox(Base=box, XCount=number_slider_14, YCount=number_slider_14, ZCount=number_slider_14)

# ----
# 3D Tower Nurbs
vec_6 = Vector(Z_2)
extr_2 = Extrude(Base=crv, Direction=vec_6)
cap_2 = CapHoles(Brep=extr_2)

floor_area_2 = Panel(int_2)

panel_6 = Panel(join)

geo = Geometry(mbox)
group = Group(Objects=geo)
geo_2 = Geometry(flatten(group))
lng_2 = ListLength(List=geo_2)
min = Minimum(A=lng, B=lng_2)
split_6 = SplitList(List=geo_2, Index=min)  # -> ListA, ListB
split_7 = SplitList(List=pt_5, Index=min)  # -> ListA, ListB
move = Move(Geometry=split_6.ListA, Motion=split_7.ListA)  # -> Geometry, Transform

geo_3 = Geometry(cap)  # disabled

# ----
# Shadow Analysis
mshadow = MeshShadow(Mesh=geo_3, Light=vec_2, Plane=PlaneXY(0, 0, 0))  # disabled
neighbor = Curve(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)  # disabled
park = Curve(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)  # disabled

# ----
# Path Mapper Magic
# 
# Kind of like Partially Flattening
path_mapper = PathMapper(mshadow, source="{A;B;C;D}", target="{A;B;C}")  # disabled
panel_8 = Panel(path_mapper)  # disabled

panel_9 = Panel(mshadow)  # disabled

# ----
# Shadow Analysis
mshadow_2 = MeshShadow(Mesh=geo, Light=vec_4, Plane=PlaneXY(0, 0, 0))
neighbor_2 = Curve(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)
park_2 = Curve(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)

panel_10 = Panel(mshadow_2)

# ----
# Path Mapper Magic
# 
# Kind of like Partially Flattening
path_mapper_2 = PathMapper(mshadow_2, source="{A;B;C;D}", target="{A;B;C}")
panel_11 = Panel(path_mapper_2)

runion = RegionUnion(Curves=path_mapper)  # disabled

# ---- group: Shadow
crv_3 = Curve(runion)  # disabled

# ----
# Matrix of Options
number_slider_15 = Slider(4, range=0..10)  # disabled
number_slider_16 = Slider(300, range=0..1000)  # disabled
number_slider_17 = Slider(4, range=0..10)  # disabled
sqgrid_4 = Square(Plane=PlaneXY(0, 0, 0), Size=number_slider_16, ExtentX=number_slider_17, ExtentY=number_slider_15)  # -> Cells, Points; disabled
group_2 = Group(Objects=geo_3)  # disabled
pt_6 = Point(flatten(sqgrid_4.Points))  # disabled
geo_4 = Geometry(flatten(group_2))  # disabled
lng_3 = ListLength(List=pt_6)  # disabled
lng_4 = ListLength(List=geo_4)  # disabled
crv_4 = Curve(flatten(crv_3))  # disabled
min_2 = Minimum(A=lng_3, B=lng_4)  # disabled
split_8 = SplitList(List=geo_4, Index=min_2)  # -> ListA, ListB; disabled
split_9 = SplitList(List=crv_4, Index=min_2)  # -> ListA, ListB; disabled
split_10 = SplitList(List=pt_6, Index=min_2)  # -> ListA, ListB; disabled
move_2 = Move(Geometry=split_9.ListA, Motion=split_10.ListA)  # -> Geometry, Transform; disabled
move_3 = Move(Geometry=split_8.ListA, Motion=split_10.ListA)  # -> Geometry, Transform; disabled

runion_2 = RegionUnion(Curves=path_mapper_2)

# ---- group: Shadow
crv_5 = Curve(runion_2)

# ----
crv_6 = Curve(flatten(crv_5))
split_11 = SplitList(List=crv_6, Index=min)  # -> ListA, ListB
move_4 = Move(Geometry=split_11.ListA, Motion=split_7.ListA)  # -> Geometry, Transform

area_2 = Area(Geometry=crv_3)  # -> Area, Centroid; disabled
rint = RegionIntersection(CurvesA=crv_3, CurvesB=neighbor)  # disabled
rint_2 = RegionIntersection(CurvesA=crv_3, CurvesB=park)  # disabled
int_4 = Integer(area_2.Area)  # disabled
area_3 = Area(Geometry=rint_2)  # -> Area, Centroid; disabled
area_4 = Area(Geometry=rint)  # -> Area, Centroid; disabled

# ----
# FIX!
null = NullItem(Item=rint)  # -> NullFlags, InvalidFlags, Description; disabled
null_2 = NullItem(Item=rint_2)  # -> NullFlags, InvalidFlags, Description; disabled
panel_12 = Panel("0")  # disabled
panel_13 = Panel("0")  # disabled
weave = Weave(Pattern=null.NullFlags, Stream0=area_4.Area, Stream1=panel_12, NullGaps=False)  # disabled
weave_2 = Weave(Pattern=null_2.NullFlags, Stream0=area_3.Area, Stream1=panel_13, NullGaps=False)  # disabled

int_5 = Integer(weave_2)  # disabled
int_6 = Integer(weave)  # disabled

total_shadow_area = Panel(int_4)  # disabled
park_shadow = Panel(int_5)  # disabled
neighbor_shadow = Panel(int_6)  # disabled

# ----
# Text Labels
panel_14 = Panel("")  # disabled
panel_15 = Panel("test")  # disabled
merge_5 = Merge(Data1=simplify(int), Data2=simplify(int_4), Data3=simplify(int_5), Data4=simplify(int_6))  # disabled
panel_16 = Panel("""Floor Area: 
Shadow Area: 
Park Shadow: 
Neighbor Area: """)  # disabled
number_slider_18 = Slider(8, range=0..10)  # disabled
concat = Concatenate(FragmentA=panel_16, FragmentB=merge_5)  # disabled
join_2 = TextJoin(Text=concat, Join=panel_14)  # disabled
panel_17 = Panel(join_2)  # disabled
data = Data(flatten(join_2))  # disabled
split_12 = SplitList(List=data, Index=min_2)  # -> ListA, ListB; disabled
tag = TextTag3D(Location=split_10.ListA, Text=split_12.ListA, Size=number_slider_18, Justification=1)  # disabled

area_5 = Area(Geometry=crv_5)  # -> Area, Centroid
rint_3 = RegionIntersection(CurvesA=crv_5, CurvesB=neighbor_2)
rint_4 = RegionIntersection(CurvesA=crv_5, CurvesB=park_2)
int_7 = Integer(area_5.Area)
area_6 = Area(Geometry=rint_4)  # -> Area, Centroid
area_7 = Area(Geometry=rint_3)  # -> Area, Centroid

total_shadow_area_2 = Panel(int_7)

# ----
# Path Mapper Magic
# 
# Kind of like Partially Flattening
null_3 = NullItem(Item=rint_3)  # -> NullFlags, InvalidFlags, Description
null_4 = NullItem(Item=rint_4)  # -> NullFlags, InvalidFlags, Description
# Matrix of Options
# Shadow Analysis
# FIX!
panel_18 = Panel("0")
weave_3 = Weave(Pattern=null_3.NullFlags, Stream0=area_7.Area, Stream1=panel_18, NullGaps=False)
weave_4 = Weave(Pattern=null_4.NullFlags, Stream0=area_6.Area, Stream1="0", NullGaps=False)

int_8 = Integer(weave_4)
int_9 = Integer(weave_3)

# ----
# 3D Tower Nurbs
# Fast Generating Mesh Model
park_shadow_2 = Panel(int_8)
# AREA FAST!!!
# Build a Sun System
# i.e. Ladybug
# Really Nice and Smart
neighbor_shadow_2 = Panel(int_9)
merge_6 = Merge(Data1=simplify(int_2), Data2=simplify(int_7), Data3=simplify(int_8), Data4=simplify(int_9))
concat_2 = Concatenate(FragmentA=panel_2, FragmentB=merge_6)
join_3 = TextJoin(Text=concat_2)
panel_19 = Panel(join_3)
data_2 = Data(flatten(join_3))
split_13 = SplitList(List=data_2, Index=min)  # -> ListA, ListB
tag_2 = TextTag3D(Location=split_7.ListA, Text=split_13.ListA, Size=number_slider_9, Justification=1)

B_17 = Slider(98, range=1..110)  # disabled
B_18 = Slider(96, range=1..110)  # disabled
B_19 = Slider(59, range=1..110)  # disabled
B_20 = Slider(88, range=1..110)  # disabled
B_21 = Slider(60, range=1..110)  # disabled
B_22 = Slider(72, range=1..110)  # disabled
B_23 = Slider(60, range=1..110)  # disabled
B_24 = Slider(53, range=1..110)  # disabled
B_25 = Slider(30, range=1..110)  # disabled

# ----
# Parametric Model capable of taking multiple states
# 
# Way to evaluate different states fo model based on a given metric, i.e. areas
# 
# Basic Computational Analysis, browse, sort and filter (custom tool)
# 
# Use the workflow
# 
# Look at Evolutionary operations
# Create a simple parametric model
# FIX!
number_slider_19 = Slider(23, range=0..100)  # disabled
number_slider_20 = Slider(3, range=0..10)  # disabled
floor_height_3 = Slider(4.5, range=0..10)  # disabled
sqgrid_5 = Square(Plane=PlaneXY(0, 0, 0), Size=number_slider_19, ExtentX=number_slider_20, ExtentY=number_slider_20)  # -> Cells, Points; disabled
merge_7 = Merge(Data1=B_19, Data2=B_20, Data3=B_18, Data4=B_21, Data6=B_22, Data7=B_23, Data8=B_24, Data9=B_25)  # disabled
crv_7 = Curve(flatten(sqgrid_5.Cells))  # disabled
area_8 = Area(Geometry=crv_7)  # -> Area, Centroid; disabled
toggle = BooleanToggle(False)  # disabled
number_slider_21 = Slider(28, range=0..100)  # disabled

number_slider_22 = Slider(4, range=0..10)  # disabled
sort_3 = SortList(Keys=merge_7)  # -> reverse(Keys), ValuesA; disabled
split_14 = SplitList(List=merge_7, Index=number_slider_22)  # -> ListA, ListB; disabled
item_5 = ListItem(List=sort_3.Keys, Index=0, Wrap=True)  # disabled
merge_8 = Merge(Data1=flatten(split_14.ListA), Data2=flatten(item_5), Data3=flatten(split_14.ListB))  # disabled
panel_20 = Panel(merge_8)  # disabled

# ----
# AREA FAST!!!
ma_3 = MassAddition(Input=merge_8)  # -> Result, PartialResults; disabled
num_3 = Number(number_slider_19)  # disabled
multiplication_5 = Multiplication(A=num_3, B=num_3, C=ma_3.Result)  # disabled
int_10 = Integer(multiplication_5)  # disabled

panel_21 = Panel(int_10)  # disabled

multiplication_6 = Multiplication(A=floor_height_3, B=merge_8)  # disabled
Z_3 = UnitZ(Factor=multiplication_6)  # disabled
vec_7 = Vector(Z_3)  # disabled
extr_3 = Extrude(Base=crv_7, Direction=vec_7)  # disabled
cap_3 = CapHoles(Brep=extr_3)  # disabled
geo_5 = Geometry(cap_3)  # disabled

# ----
# Create a simple parametric model
# AREA SLOW!!!
num_4 = Number(floor_height_3)  # disabled
geo_6 = Geometry(geo_5)  # disabled
contour = Contour(Shape=geo_6, Point=Point(0, 0, 0), Direction=Vector(0, 0, 1), Distance=num_4)  # disabled
crv_8 = Curve(contour)  # disabled
area_9 = Area(Geometry=crv_8)  # -> Area, Centroid; disabled
ma_4 = MassAddition(Input=flatten(area_9.Area))  # -> Result, PartialResults; disabled

# ----
# Wickerson Custom Jazz
number_slider_23 = Slider(1.46, range=0..2)  # disabled
number_slider_24 = Slider(0.47, range=0..2)  # disabled
number_slider_25 = Slider(5, range=0..5)  # disabled
volume = Volume(Geometry=geo_5)  # -> Volume, Centroid; disabled
lng_5 = ListLength(List=geo_5)  # disabled
debrep = DeconstructBrep(Brep=geo_5)  # -> Faces, Edges, Vertices; disabled
dom_2 = ConstructDomain(DomainStart=number_slider_24, DomainEnd=number_slider_23)  # disabled
range = Range(Domain=dom_2, Steps=expr("x-1", lng_5))  # disabled
item_6 = ListItem(List=debrep.Faces, Index=number_slider_25, Wrap=True)  # disabled
pi = Pi(Factor=range)  # disabled
area_10 = Area(Geometry=item_6)  # -> Area, Centroid; disabled
ln = Line(StartPoint=area_8.Centroid, EndPoint=flatten(area_10.Centroid))  # disabled
rot3d = Rotate3D(Geometry=geo_5, Angle=pi, Center=volume.Centroid, Axis=ln)  # -> Geometry, Transform; disabled

panel_22 = Panel(ma_4.Result)  # disabled

# ----
# Build a Sun System
# i.e. Ladybug
number_slider_26 = Slider(550, range=0..1000)  # disabled
number_slider_27 = Slider(0.62, range=0..1)  # disabled
number_slider_28 = Slider(0.8, range=0.5..1)  # disabled
sph_3 = Sphere(Base=PlaneXY(0, 0, 0), Radius=number_slider_26)  # disabled
sec_3 = BrepPlane(Brep=sph_3, Plane=PlaneXY(0, 0, 0))  # -> Curves, Points; disabled
srfsplit_3 = SurfaceSplit(Surface=sph_3, Curves=sec_3.Curves)  # disabled
split_15 = SplitBrep(Brep=sph_3, Cutter=sec_3.Curves)  # disabled
pt_7 = ConstructPoint(XCoordinate=number_slider_27, YCoordinate=number_slider_28, ZCoordinate=0)  # disabled
item_7 = ListItem(List=srfsplit_3, Index=toggle, Wrap=True)  # disabled
number_slider_29 = Slider(287, range=0..1000)  # disabled
swatch_2 = ColourSwatch(SwatchColor=RGB(0, 255, 255))  # disabled

# ----
# Wickerson Custom Jazz
md_slider = MDSlider(
    SliderMode=0,
    slider_value=Point(0.790446956, 0.8977698349, 0.5),
    x_domain=Domain(0, 1),
    y_domain=Domain(0, 1),
    z_domain=Domain(0, 1))  # disabled
number_slider_30 = Slider(187, range=100..1000)  # disabled
number_slider_31 = Slider(1000, range=100..1000)  # disabled
number_slider_32 = Slider(0.87, range=0..1)  # disabled
number_slider_33 = Slider(0.1, range=0..1)  # disabled
number_slider_34 = Slider(0.67, range=0..1)  # disabled
polygon = Polygon(Plane=PlaneXY(0, 0, 0), Radius=number_slider_31, Segments=6, FilletRadius=0)  # -> Polygon, Length; disabled
sph_4 = Sphere(Base=PlaneXY(0, 0, 0), Radius=number_slider_30)  # disabled
vec_8 = VectorXYZ(XComponent=number_slider_33, YComponent=number_slider_32, ZComponent=number_slider_34)  # -> Vector, Length; disabled
crv_9 = Curve(polygon.Polygon)  # disabled

evalsrf_3 = EvaluateSurface(Surface=reparameterize(item_7), Point=md_slider)  # -> Point, Normal, UDirection, VDirection, Frame; disabled
iso_3 = IsoCurve(Surface=reparameterize(item_7), UVPoint=md_slider)  # -> UIsocurve, VIsocurve; disabled
pt_8 = Point(evalsrf_3.Point)  # disabled
vec_9 = Vector(evalsrf_3.Point)  # disabled
rev_3 = Reverse(Vector=vec_9)  # disabled
amp_3 = Amplitude(Vector=rev_3, Amplitude=number_slider_29)  # disabled
vdisex_3 = VectorDisplayEx(Point=pt_8, Vector=amp_3, Colour=swatch_2, Width=2)  # disabled
vec_10 = Vector(amp_3)  # disabled

sph_5 = Sphere(Base=pt_8, Radius=number_slider_21)  # disabled

# ---- group: ObjectB
neighbor_3 = Curve(crv_9)  # disabled

# ----
# Shadow Analysis
mshadow_3 = MeshShadow(Mesh=rot3d.Geometry, Light=vec_10, Plane=PlaneXY(0, 0, 0))  # disabled
runion_3 = RegionUnion(Curves=flatten(mshadow_3))  # disabled

project = Project(Curve=runion_3, Brep=sph_4, Direction=vec_8.Vector)  # disabled
crv_10 = Curve(project)  # disabled
project_2 = Project(Curve=crv_10, Brep=crv_9, Direction=Vector(0, 0, 1))  # disabled
dispatch = Dispatch(List=project, DispatchPattern=[True, False])  # -> ListA, ListB; disabled
runion_4 = RegionUnion(Curves=project_2)  # disabled
crv_11 = Curve(dispatch.ListA)  # disabled
crv_12 = Curve(dispatch.ListB)  # disabled

# ---- group: ObjectA
park_3 = Curve(runion_4)  # disabled

# ---- group: Shadow
crv_13 = Curve(runion_3)  # disabled

# ----
area_11 = Area(Geometry=crv_13)  # -> Area, Centroid; disabled
rint_5 = RegionIntersection(CurvesA=crv_13, CurvesB=neighbor_3)  # disabled
rint_6 = RegionIntersection(CurvesA=crv_13, CurvesB=park_3)  # disabled
int_11 = Integer(area_11.Area)  # disabled
area_12 = Area(Geometry=rint_6)  # -> Area, Centroid; disabled
area_13 = Area(Geometry=rint_5)  # -> Area, Centroid; disabled

null_5 = NullItem(Item=rint_5)  # -> NullFlags, InvalidFlags, Description; disabled
null_6 = NullItem(Item=rint_6)  # -> NullFlags, InvalidFlags, Description; disabled
panel_23 = Panel("0")  # disabled
panel_24 = Panel("0")  # disabled
weave_5 = Weave(Pattern=null_6.NullFlags, Stream0=area_12.Area, Stream1=panel_24, NullGaps=False)  # disabled
weave_6 = Weave(Pattern=null_5.NullFlags, Stream0=area_13.Area, Stream1=panel_23, NullGaps=False)  # disabled

int_12 = Integer(weave_6)  # disabled
int_13 = Integer(weave_5)  # disabled

park_shadow_3 = Panel(int_13)  # disabled
total_shadow_area_3 = Panel(int_11)  # disabled
neighbor_shadow_3 = Panel(int_12)  # disabled

# ----
# Wickerson Custom Jazz
toggle_2 = BooleanToggle(True)  # disabled
number_slider_35 = Slider(77, range=0..100)  # disabled
lng_6 = ListLength(List=flatten(rint_6))  # disabled
clean_2 = CleanTree(RemoveNulls=toggle_2, RemoveInvalid=toggle_2, RemoveEmpty=toggle_2, Tree=rint_6)  # disabled
range_2 = Range(Domain=number_slider_35, Steps=expr("x-1", lng_6))  # disabled
Z_4 = UnitZ(Factor=range_2)  # disabled
extr_4 = Extrude(Base=simplify(graft(clean_2)), Direction=simplify(graft(Z_4)))  # disabled
panel_25 = Panel("0")  # disabled
cap_4 = CapHoles(Brep=extr_4)  # disabled
cull_i = CullIndex(List=flatten(cap_4), Indices=panel_25, Wrap=True)  # disabled
panel_26 = Panel(cull_i)  # disabled
