# Grasshopper definition GenerativeDesign_WS_002D.gh (Grasshopper 1.0.7)
# plug-ins: Bifocals, MeshEdit Components

# ----
# Build a Sun System
# i.e. Ladybug
number_slider = Slider(550, range=0..1000)  # disabled
number_slider_2 = Slider(0.6, range=0..1)  # disabled
number_slider_3 = Slider(0.87, range=0.5..1)  # disabled
sph = Sphere(Base=PlaneXY(0, 0, 0), Radius=number_slider)  # disabled
sec = BrepPlane(Brep=sph, Plane=PlaneXY(0, 0, 0))  # -> Curves, Points; disabled
srfsplit = SurfaceSplit(Surface=sph, Curves=sec.Curves)  # disabled
split = SplitBrep(Brep=sph, Cutter=sec.Curves)  # disabled
pt = ConstructPoint(XCoordinate=number_slider_2, YCoordinate=number_slider_3, ZCoordinate=0)  # disabled
item = ListItem(List=srfsplit, Index=0, Wrap=True)  # disabled
evalsrf = EvaluateSurface(Surface=reparameterize(item), Point=pt)  # -> Point, Normal, UDirection, VDirection, Frame; disabled
iso = IsoCurve(Surface=reparameterize(item), UVPoint=pt)  # -> UIsocurve, VIsocurve; disabled
number_slider_4 = Slider(287, range=0..1000)  # disabled
pt_2 = Point(evalsrf.Point)  # disabled
vec = Vector(evalsrf.Point)  # disabled
rev = Reverse(Vector=vec)  # disabled
swatch = ColourSwatch(SwatchColor=RGB(0, 255, 255))  # disabled
amp = Amplitude(Vector=rev, Amplitude=number_slider_4)  # disabled
vdisex = VectorDisplayEx(Point=pt_2, Vector=amp, Colour=swatch, Width=2)  # disabled
vec_2 = Vector(amp)  # disabled

number_slider_5 = Slider(30, range=0..100)
series = Series(Start=number_slider_5, Step=number_slider_5, Count=Slider(3, range=0..10))
# Parametric Model capable of taking multiple states
# 
# Way to evaluate different states fo model based on a given metric, i.e. areas
# 
# Basic Computational Analysis, browse, sort and filter (custom tool)
# 
# Use the workflow
# 
# Look at Evolutionary operations
# Create a simple parametric model
number_slider_6 = Slider(23, range=0..100)
number_slider_7 = Slider(3, range=0..10)
floor_height = Slider(4.5, range=0..10)
crossref = CrossReference(
    ListA=series,
    ListB=series,
    ListC=series,
    ListD=series,
    ListE=series,
    ListF=series,
    ListG=series,
    ListH=series,
    CrossMode=1)  # -> ListA, ListB, ListC, ListD, ListE, ListF, ListG, ListH
sqgrid = Square(Plane=PlaneXY(0, 0, 0), Size=number_slider_6, ExtentX=number_slider_7, ExtentY=number_slider_7)  # -> Cells, Points
merge = Merge(
    Data1=graft(crossref.ListA),
    Data2=graft(crossref.ListB),
    Data3=graft(crossref.ListC),
    Data4=graft(crossref.ListD),
    Data6=graft(crossref.ListE),
    Data7=graft(crossref.ListF),
    Data8=graft(crossref.ListG),
    Data9=graft(crossref.ListH))
crv = Curve(flatten(sqgrid.Cells))

# ----
# Parametric Model capable of taking multiple states
# 
# Way to evaluate different states fo model based on a given metric, i.e. areas
# 
# Basic Computational Analysis, browse, sort and filter (custom tool)
# 
# Use the workflow
# 
# Look at Evolutionary opperations
# Create a simple parametric model
# FIX!
number_slider_8 = Slider(30, range=0..100)  # disabled
number_slider_9 = Slider(3, range=0..10)  # disabled
series_2 = Series(Start=number_slider_8, Step=number_slider_8, Count=number_slider_9)  # disabled
number_slider_10 = Slider(23, range=0..100)  # disabled
number_slider_11 = Slider(3, range=0..10)  # disabled
floor_height_2 = Slider(4.5, range=0..10)  # disabled
crossref_2 = CrossReference(
    ListA=series_2,
    ListB=series_2,
    ListC=series_2,
    ListD=series_2,
    ListE=series_2,
    ListF=series_2,
    ListG=series_2,
    ListH=series_2,
    CrossMode=1)  # -> ListA, ListB, ListC, ListD, ListE, ListF, ListG, ListH; disabled
merge_2 = Merge(
    Data1=graft(crossref_2.ListA),
    Data2=graft(crossref_2.ListB),
    Data3=graft(crossref_2.ListC),
    Data4=graft(crossref_2.ListD),
    Data6=graft(crossref_2.ListE),
    Data7=graft(crossref_2.ListF),
    Data8=graft(crossref_2.ListG),
    Data9=graft(crossref_2.ListH))  # disabled
sqgrid_2 = Square(Plane=PlaneXY(0, 0, 0), Size=number_slider_10, ExtentX=number_slider_11, ExtentY=number_slider_11)  # -> Cells, Points; disabled
crv_2 = Curve(flatten(sqgrid_2.Cells))  # disabled

number_slider_12 = Slider(4, range=0..10)  # disabled
sort = SortList(Keys=merge_2)  # -> reverse(Keys), ValuesA; disabled
split_2 = SplitList(List=merge_2, Index=number_slider_12)  # -> ListA, ListB; disabled
item_2 = ListItem(List=sort.Keys, Index=0, Wrap=True)  # disabled
merge_3 = Merge(Data1=simplify(split_2.ListA), Data2=simplify(item_2), Data3=simplify(split_2.ListB))  # disabled
panel = Panel(merge_3)  # disabled

# ----
# AREA FAST!!!
ma = MassAddition(Input=merge_3)  # -> Result, PartialResults; disabled
num = Number(number_slider_10)  # disabled
multiplication = Multiplication(A=num, B=num, C=ma.Result)  # disabled
int = Integer(multiplication)  # disabled

# ----
# Really Nice and Smart
number_slider_13 = Slider(357489, range=0..1000000)  # disabled
panel_2 = Panel("-")  # disabled
join = TextJoin(Text=merge_3, Join=panel_2)  # disabled
larger = LargerThan(FirstNumber=int, SecondNumber=number_slider_13)  # -> LargerThan, OrEqualTo; disabled
cull = CullPattern(List=join, CullPattern=larger.LargerThan)  # disabled
panel_3 = Panel(larger.LargerThan)  # disabled
split_3 = TextSplit(Text=cull, Separators=panel_2)  # disabled
clean = CleanTree(RemoveNulls=True, RemoveInvalid=True, RemoveEmpty=True, Tree=split_3)  # disabled
heights = Integer(clean)  # disabled
viewer = ParamViewer(heights)  # disabled

panel_4 = Panel(join)  # disabled

multiplication_2 = Multiplication(A=floor_height_2, B=heights)  # disabled
viewer_2 = ParamViewer(int)  # disabled
Z = UnitZ(Factor=multiplication_2)  # disabled
floor_area = Panel(int)  # disabled

# ----
# Fast Generating Mesh Model
int_2 = Integer(number_slider_10)  # disabled
panel_6 = Panel("2")  # disabled
division = Division(A=int_2, B=panel_6)  # disabled
dom = ConstructDomain(DomainStart=expr("-x", division), DomainEnd=division)  # disabled
area = Area(Geometry=crv_2)  # -> Area, Centroid; disabled
number_slider_14 = Slider(1, range=0..1)  # disabled
box = DomainBox(Base=area.Centroid, X=dom, Y=dom, Z=multiplication_2)  # disabled
mbox = MeshBox(Base=box, XCount=number_slider_14, YCount=number_slider_14, ZCount=number_slider_14)  # disabled

# ----
# 3D Tower Nurbs
vec_3 = Vector(Z)  # disabled
extr = Extrude(Base=crv_2, Direction=vec_3)  # disabled
cap = CapHoles(Brep=extr)  # disabled

geo = Geometry(mbox)  # disabled

# ----
# Shadow Analysis
mshadow = MeshShadow(Mesh=geo, Light=vec_2, Plane=PlaneXY(0, 0, 0))  # disabled
neighbor = Curve(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)  # disabled
park = Curve(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)  # disabled

# ----
# Path Mapper Magic
# 
# Kind of like Partially Flattening
path_mapper = PathMapper(mshadow, source="{A;B;C;D}", target="{A;B;C}")  # disabled
panel_7 = Panel(path_mapper)  # disabled

panel_8 = Panel(mshadow)  # disabled

runion = RegionUnion(Curves=path_mapper)  # disabled

# ---- group: Shadow
crv_3 = Curve(runion)  # disabled

# ----
# Matrix of Options
number_slider_15 = Slider(300, range=0..1000)  # disabled
number_slider_16 = Slider(5, range=0..10)  # disabled
number_slider_17 = Slider(4, range=0..10)  # disabled
sqgrid_3 = Square(Plane=PlaneXY(0, 0, 0), Size=number_slider_15, ExtentX=number_slider_17, ExtentY=number_slider_16)  # -> Cells, Points; disabled
group = Group(Objects=geo)  # disabled
pt_3 = Point(flatten(sqgrid_3.Points))  # disabled
geo_2 = Geometry(flatten(group))  # disabled
lng = ListLength(List=pt_3)  # disabled
lng_2 = ListLength(List=geo_2)  # disabled
crv_4 = Curve(flatten(crv_3))  # disabled
min = Minimum(A=lng, B=lng_2)  # disabled
split_4 = SplitList(List=geo_2, Index=min)  # -> ListA, ListB; disabled
split_5 = SplitList(List=crv_4, Index=min)  # -> ListA, ListB; disabled
split_6 = SplitList(List=pt_3, Index=min)  # -> ListA, ListB; disabled
move = Move(Geometry=split_5.ListA, Motion=split_6.ListA)  # -> Geometry, Transform; disabled
move_2 = Move(Geometry=split_4.ListA, Motion=split_6.ListA)  # -> Geometry, Transform; disabled

area_2 = Area(Geometry=crv_3)  # -> Area, Centroid; disabled
rint = RegionIntersection(CurvesA=crv_3, CurvesB=neighbor)  # disabled
rint_2 = RegionIntersection(CurvesA=crv_3, CurvesB=park)  # disabled
int_3 = Integer(area_2.Area)  # disabled
area_3 = Area(Geometry=rint_2)  # -> Area, Centroid; disabled
area_4 = Area(Geometry=rint)  # -> Area, Centroid; disabled

null = NullItem(Item=rint)  # -> NullFlags, InvalidFlags, Description; disabled
null_2 = NullItem(Item=rint_2)  # -> NullFlags, InvalidFlags, Description; disabled
# FIX!
panel_9 = Panel("0")  # disabled
panel_10 = Panel("0")  # disabled
weave = Weave(Pattern=null.NullFlags, Stream0=area_4.Area, Stream1=panel_9, NullGaps=False)  # disabled
weave_2 = Weave(Pattern=null_2.NullFlags, Stream0=area_3.Area, Stream1=panel_10, NullGaps=False)  # disabled

int_4 = Integer(weave_2)  # disabled
int_5 = Integer(weave)  # disabled

total_shadow_area = Panel(int_3)  # disabled
park_shadow = Panel(int_4)  # disabled
neighbor_shadow = Panel(int_5)  # disabled

# ----
# Text Labels
panel_11 = Panel("")  # disabled
panel_12 = Panel("test")  # disabled
merge_4 = Merge(Data1=simplify(int), Data2=simplify(int_3), Data3=simplify(int_4), Data4=simplify(int_5))  # disabled
panel_13 = Panel("""Floor Area: 
Shadow Area: 
Park Shadow: 
Neighbor Area: """)  # disabled
number_slider_18 = Slider(8, range=0..10)  # disabled
concat = Concatenate(FragmentA=panel_13, FragmentB=merge_4)  # disabled
join_2 = TextJoin(Text=concat, Join=panel_11)  # disabled
panel_14 = Panel(join_2)  # disabled
data = Data(flatten(join_2))  # disabled
split_7 = SplitList(List=data, Index=min)  # -> ListA, ListB; disabled
tag = TextTag3D(Location=split_6.ListA, Text=split_7.ListA, Size=number_slider_18, Justification=1)  # disabled

sort_2 = SortList(Keys=merge, ValuesA=merge)  # -> reverse(Keys), ValuesA
split_8 = SplitList(List=merge, Index=Slider(4, range=0..10))  # -> ListA, ListB
item_3 = ListItem(List=sort_2.Keys, Index=0, Wrap=True)

merge_5 = Merge(Data1=simplify(split_8.ListA), Data2=simplify(item_3), Data3=simplify(split_8.ListB))
multiplication_3 = Multiplication(A=floor_height, B=merge_5)

# ----
# Fast Generating Mesh Model
int_6 = Integer(number_slider_6)
division_2 = Division(A=int_6, B="2")
dom_2 = ConstructDomain(DomainStart=expr("-x", division_2), DomainEnd=division_2)
area_5 = Area(Geometry=crv)  # -> Area, Centroid
number_slider_19 = Slider(1, range=0..1)
box_2 = DomainBox(Base=area_5.Centroid, X=dom_2, Y=dom_2, Z=multiplication_3)
mbox_2 = MeshBox(Base=box_2, XCount=number_slider_19, YCount=number_slider_19, ZCount=number_slider_19)

panel_15 = Panel(merge_5)
geo_3 = Geometry(mbox_2)

# ----
# AREA FAST!!!
ma_2 = MassAddition(Input=merge_5)  # -> Result, PartialResults
num_2 = Number(number_slider_6)
multiplication_4 = Multiplication(A=num_2, B=num_2, C=ma_2.Result)
int_7 = Integer(multiplication_4)

panel_17 = Panel(int_7)  # disabled
volume = MeshVolume(Mesh=geo_3)  # -> Volume, Centroid

# ----
# Wickerson Custom Jazz
number_slider_20 = Slider(1.46, range=0..2)
lng_3 = ListLength(List=geo_3)
dom_3 = ConstructDomain(DomainStart=Slider(0.47, range=0..2), DomainEnd=number_slider_20)
range = Range(Domain=dom_3, Steps=expr("x-1", lng_3))
item_4 = ListItem(List=geo_3, Index=Slider(5, range=0..5), Wrap=True)
pi = Pi(Factor=range)

panel_18 = Panel(item_4)
area_6 = MeshArea(Mesh=item_4)  # -> Area, Centroid

ln = Line(StartPoint=area_5.Centroid, EndPoint=flatten(area_6.Centroid))
rot3d = Rotate3D(Geometry=item_4, Angle=pi, Center=volume.Centroid, Axis=ln)  # -> Geometry, Transform; disabled

# ----
# Build a Sun System
# i.e. Ladybug
number_slider_21 = Slider(550, range=0..1000)
sph_2 = Sphere(Base=PlaneXY(0, 0, 0), Radius=number_slider_21)
sec_2 = BrepPlane(Brep=sph_2, Plane=PlaneXY(0, 0, 0))  # -> Curves, Points
srfsplit_2 = SurfaceSplit(Surface=sph_2, Curves=sec_2.Curves)
split_9 = SplitBrep(Brep=sph_2, Cutter=sec_2.Curves)
pt_4 = ConstructPoint(XCoordinate=Slider(0.62, range=0..1), YCoordinate=Slider(0.8, range=0.5..1), ZCoordinate=0)
item_5 = ListItem(List=srfsplit_2, Index=Toggle(False), Wrap=True)

# ----
# Wickerson Custom Jazz
md_slider = MDSlider(
    SliderMode=0,
    slider_value=Point(0.790446956, 0.8977698349, 0.5),
    x_domain=Domain(0, 1),
    y_domain=Domain(0, 1),
    z_domain=Domain(0, 1))
number_slider_22 = Slider(187, range=100..1000)  # disabled
number_slider_23 = Slider(1000, range=100..1000)  # disabled
number_slider_24 = Slider(0.1, range=0..1)  # disabled
number_slider_25 = Slider(0.87, range=0..1)  # disabled
number_slider_26 = Slider(0.67, range=0..1)  # disabled
polygon = Polygon(Plane=PlaneXY(0, 0, 0), Radius=number_slider_23, Segments=6, FilletRadius=0)  # -> Polygon, Length; disabled
sph_3 = Sphere(Base=PlaneXY(0, 0, 0), Radius=number_slider_22)  # disabled
vec_4 = VectorXYZ(XComponent=number_slider_24, YComponent=number_slider_25, ZComponent=number_slider_26)  # -> Vector, Length; disabled
crv_5 = Curve(polygon.Polygon)  # disabled

evalsrf_2 = EvaluateSurface(Surface=reparameterize(item_5), Point=md_slider)  # -> Point, Normal, UDirection, VDirection, Frame
iso_2 = IsoCurve(Surface=reparameterize(item_5), UVPoint=md_slider)  # -> UIsocurve, VIsocurve
pt_5 = Point(evalsrf_2.Point)
vec_5 = Vector(evalsrf_2.Point)
rev_2 = Reverse(Vector=vec_5)
amp_2 = Amplitude(Vector=rev_2, Amplitude=Slider(287, range=0..1000))
vdisex_2 = VectorDisplayEx(Point=pt_5, Vector=amp_2, Colour=ColourSwatch(SwatchColor=RGB(0, 255, 255)), Width=2)
vec_6 = Vector(amp_2)

sph_4 = Sphere(Base=pt_5, Radius=Slider(28, range=0..100))

# ---- group: ObjectB
neighbor_2 = Curve(crv_5)  # disabled

# ----
# Shadow Analysis
mshadow_2 = MeshShadow(Mesh=rot3d.Geometry, Light=vec_6, Plane=PlaneXY(0, 0, 0))  # disabled

# ----
# Path Mapper Magic
# 
# Kind of like Partially Flattening
path_mapper_2 = PathMapper(mshadow_2, source="{A;B;C;D}", target="{A;B;C}")  # disabled
panel_19 = Panel(path_mapper_2)  # disabled

runion_2 = RegionUnion(Curves=path_mapper_2)  # disabled

# ---- group: Shadow
crv_6 = Curve(runion_2)  # disabled

# ----
project = Project(Curve=runion_2, Brep=sph_3, Direction=vec_4.Vector)  # disabled
crv_7 = Curve(project)  # disabled
project_2 = Project(Curve=crv_7, Brep=crv_5, Direction=Vector(0, 0, 1))  # disabled
dispatch = Dispatch(List=project, DispatchPattern=[True, False])  # -> ListA, ListB; disabled
runion_3 = RegionUnion(Curves=project_2)  # disabled
crv_8 = Curve(dispatch.ListA)  # disabled
crv_9 = Curve(dispatch.ListB)  # disabled

# ---- group: ObjectA
park_2 = Curve(runion_3)  # disabled

# ----
# Matrix of Options
number_slider_27 = Slider(300, range=0..1000)  # disabled
number_slider_28 = Slider(5, range=0..10)  # disabled
number_slider_29 = Slider(4, range=0..10)  # disabled
sqgrid_4 = Square(Plane=PlaneXY(0, 0, 0), Size=number_slider_27, ExtentX=number_slider_29, ExtentY=number_slider_28)  # -> Cells, Points; disabled
group_2 = Group(Objects=geo_3)  # disabled
pt_6 = Point(flatten(sqgrid_4.Points))  # disabled
geo_4 = Geometry(flatten(group_2))  # disabled
lng_4 = ListLength(List=pt_6)  # disabled
lng_5 = ListLength(List=geo_4)  # disabled
crv_10 = Curve(flatten(crv_6))  # disabled
min_2 = Minimum(A=lng_4, B=lng_5)  # disabled
split_10 = SplitList(List=geo_4, Index=min_2)  # -> ListA, ListB; disabled
split_11 = SplitList(List=crv_10, Index=min_2)  # -> ListA, ListB; disabled
split_12 = SplitList(List=pt_6, Index=min_2)  # -> ListA, ListB; disabled
move_3 = Move(Geometry=split_11.ListA, Motion=split_12.ListA)  # -> Geometry, Transform; disabled
move_4 = Move(Geometry=split_10.ListA, Motion=split_12.ListA)  # -> Geometry, Transform; disabled

area_7 = Area(Geometry=crv_6)  # -> Area, Centroid; disabled
rint_3 = RegionIntersection(CurvesA=crv_6, CurvesB=neighbor_2)  # disabled
rint_4 = RegionIntersection(CurvesA=crv_6, CurvesB=park_2)  # disabled
int_8 = Integer(area_7.Area)  # disabled
area_8 = Area(Geometry=rint_4)  # -> Area, Centroid; disabled
area_9 = Area(Geometry=rint_3)  # -> Area, Centroid; disabled

total_shadow_area_2 = Panel(int_8)  # disabled

null_3 = NullItem(Item=rint_3)  # -> NullFlags, InvalidFlags, Description; disabled
null_4 = NullItem(Item=rint_4)  # -> NullFlags, InvalidFlags, Description; disabled
panel_20 = Panel("0")  # disabled
panel_21 = Panel("0")  # disabled
weave_3 = Weave(Pattern=null_4.NullFlags, Stream0=area_8.Area, Stream1=panel_20, NullGaps=False)  # disabled
weave_4 = Weave(Pattern=null_3.NullFlags, Stream0=area_9.Area, Stream1=panel_21, NullGaps=False)  # disabled

int_9 = Integer(weave_3)  # disabled
int_10 = Integer(weave_4)  # disabled

park_shadow_2 = Panel(int_9)  # disabled
neighbor_shadow_2 = Panel(int_10)  # disabled

# ----
# Text Labels
panel_22 = Panel("")  # disabled
merge_6 = Merge(Data1=simplify(int_7), Data2=simplify(int_8), Data3=simplify(int_9), Data4=simplify(int_10))  # disabled
panel_24 = Panel("""Floor Area: 
Shadow Area: 
Park Shadow: 
Neighbor Area: """)  # disabled
number_slider_30 = Slider(8, range=0..10)  # disabled
concat_2 = Concatenate(FragmentA=panel_24, FragmentB=merge_6)  # disabled
join_3 = TextJoin(Text=concat_2, Join=panel_22)  # disabled
panel_25 = Panel(join_3)  # disabled
data_2 = Data(flatten(join_3))  # disabled
split_13 = SplitList(List=data_2, Index=min_2)  # -> ListA, ListB; disabled
tag_2 = TextTag3D(Location=split_12.ListA, Text=split_13.ListA, Size=number_slider_30, Justification=1)  # disabled

# ----
# Wickerson Custom Jazz
toggle = BooleanToggle(True)  # disabled
number_slider_31 = Slider(77, range=0..100)  # disabled
lng_6 = ListLength(List=flatten(rint_4))  # disabled
clean_2 = CleanTree(RemoveNulls=toggle, RemoveInvalid=toggle, RemoveEmpty=toggle, Tree=rint_4)  # disabled
range_2 = Range(Domain=number_slider_31, Steps=expr("x-1", lng_6))  # disabled
Z_2 = UnitZ(Factor=range_2)  # disabled
extr_2 = Extrude(Base=simplify(graft(clean_2)), Direction=simplify(graft(Z_2)))  # disabled
panel_26 = Panel("0")  # disabled
cap_2 = CapHoles(Brep=extr_2)  # disabled
cull_i = CullIndex(List=flatten(cap_2), Indices=panel_26, Wrap=True)  # disabled
panel_27 = Panel(cull_i)  # disabled
