# Grasshopper definition GenerativeDesign_WS_002E.gh (Grasshopper 1.0.7)
# plug-ins: Bifocals

# ----
# Build a Sun System
# i.e. Ladybug
number_slider = Slider(550, range=0..1000)  # disabled
number_slider_2 = Slider(0.6, range=0..1)  # disabled
number_slider_3 = Slider(0.87, range=0.5..1)  # disabled
sph = Sphere(Base=PlaneXY(0, 0, 0), Radius=number_slider)  # disabled
sec = BrepPlane(Brep=sph, Plane=PlaneXY(0, 0, 0))  # -> Curves, Points; disabled
srfsplit = SurfaceSplit(Surface=sph, Curves=sec.Curves)  # disabled
split = SplitBrep(Brep=sph, Cutter=sec.Curves)  # disabled
pt = ConstructPoint(XCoordinate=number_slider_2, YCoordinate=number_slider_3, ZCoordinate=0)  # disabled
item = ListItem(List=srfsplit, Index=0, Wrap=True)  # disabled
evalsrf = EvaluateSurface(Surface=reparameterize(item), Point=pt)  # -> Point, Normal, UDirection, VDirection, Frame; disabled
iso = IsoCurve(Surface=reparameterize(item), UVPoint=pt)  # -> UIsocurve, VIsocurve; disabled
number_slider_4 = Slider(287, range=0..1000)  # disabled
pt_2 = Point(evalsrf.Point)  # disabled
vec = Vector(evalsrf.Point)  # disabled
rev = Reverse(Vector=vec)  # disabled
swatch = ColourSwatch(SwatchColor=RGB(0, 255, 255))  # disabled
amp = Amplitude(Vector=rev, Amplitude=number_slider_4)  # disabled
vdisex = VectorDisplayEx(Point=pt_2, Vector=amp, Colour=swatch, Width=2)  # disabled
vec_2 = Vector(amp)  # disabled

# ----
# Parametric Model capable of taking multiple states
# 
# Way to evaluate different states fo model based on a given metric, i.e. areas
# 
# Basic Computational Analysis, browse, sort and filter (custom tool)
# 
# Use the workflow
# 
# Look at Evolutionary opperations
# Create a simple parametric model
# FIX!
number_slider_5 = Slider(30, range=0..100)  # disabled
number_slider_6 = Slider(3, range=0..10)  # disabled
series = Series(Start=number_slider_5, Step=number_slider_5, Count=number_slider_6)  # disabled
number_slider_7 = Slider(23, range=0..100)  # disabled
number_slider_8 = Slider(3, range=0..10)  # disabled
floor_height = Slider(4.5, range=0..10)  # disabled
crossref = CrossReference(
    ListA=series,
    ListB=series,
    ListC=series,
    ListD=series,
    ListE=series,
    ListF=series,
    ListG=series,
    ListH=series,
    CrossMode=1)  # -> ListA, ListB, ListC, ListD, ListE, ListF, ListG, ListH; disabled
merge = Merge(
    Data1=graft(crossref.ListA),
    Data2=graft(crossref.ListB),
    Data3=graft(crossref.ListC),
    Data4=graft(crossref.ListD),
    Data6=graft(crossref.ListE),
    Data7=graft(crossref.ListF),
    Data8=graft(crossref.ListG),
    Data9=graft(crossref.ListH))  # disabled
sqgrid = Square(Plane=PlaneXY(0, 0, 0), Size=number_slider_7, ExtentX=number_slider_8, ExtentY=number_slider_8)  # -> Cells, Points; disabled
crv = Curve(flatten(sqgrid.Cells))  # disabled

number_slider_9 = Slider(4, range=0..10)  # disabled
sort = SortList(Keys=merge)  # -> reverse(Keys), ValuesA; disabled
split_2 = SplitList(List=merge, Index=number_slider_9)  # -> ListA, ListB; disabled
item_2 = ListItem(List=sort.Keys, Index=0, Wrap=True)  # disabled
merge_2 = Merge(Data1=simplify(split_2.ListA), Data2=simplify(item_2), Data3=simplify(split_2.ListB))  # disabled
panel = Panel(merge_2)  # disabled

# ----
# AREA FAST!!!
ma = MassAddition(Input=merge_2)  # -> Result, PartialResults; disabled
num = Number(number_slider_7)  # disabled
multiplication = Multiplication(A=num, B=num, C=ma.Result)  # disabled
int = Integer(multiplication)  # disabled

# ----
# Really Nice and Smart
number_slider_10 = Slider(357489, range=0..1000000)  # disabled
panel_2 = Panel("-")  # disabled
join = TextJoin(Text=merge_2, Join=panel_2)  # disabled
larger = LargerThan(FirstNumber=int, SecondNumber=number_slider_10)  # -> LargerThan, OrEqualTo; disabled
cull = CullPattern(List=join, CullPattern=larger.LargerThan)  # disabled
panel_3 = Panel(larger.LargerThan)  # disabled
split_3 = TextSplit(Text=cull, Separators=panel_2)  # disabled
clean = CleanTree(RemoveNulls=True, RemoveInvalid=True, RemoveEmpty=True, Tree=split_3)  # disabled
heights = Integer(clean)  # disabled
viewer = ParamViewer(heights)  # disabled

panel_4 = Panel(join)  # disabled

multiplication_2 = Multiplication(A=floor_height, B=heights)  # disabled
viewer_2 = ParamViewer(int)  # disabled
Z = UnitZ(Factor=multiplication_2)  # disabled
floor_area = Panel(int)  # disabled

# ----
# Fast Generating Mesh Model
int_2 = Integer(number_slider_7)  # disabled
panel_6 = Panel("2")  # disabled
division = Division(A=int_2, B=panel_6)  # disabled
dom = ConstructDomain(DomainStart=expr("-x", division), DomainEnd=division)  # disabled
area = Area(Geometry=crv)  # -> Area, Centroid; disabled
number_slider_11 = Slider(1, range=0..1)  # disabled
box = DomainBox(Base=area.Centroid, X=dom, Y=dom, Z=multiplication_2)  # disabled
mbox = MeshBox(Base=box, XCount=number_slider_11, YCount=number_slider_11, ZCount=number_slider_11)  # disabled

# ----
# 3D Tower Nurbs
vec_3 = Vector(Z)  # disabled
extr = Extrude(Base=crv, Direction=vec_3)  # disabled
cap = CapHoles(Brep=extr)  # disabled

geo = Geometry(mbox)  # disabled

# ----
# Shadow Analysis
mshadow = MeshShadow(Mesh=geo, Light=vec_2, Plane=PlaneXY(0, 0, 0))  # disabled
neighbor = Curve(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)  # disabled
park = Curve(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)  # disabled

# ----
# Path Mapper Magic
# 
# Kind of like Partially Flattening
path_mapper = PathMapper(mshadow, source="{A;B;C;D}", target="{A;B;C}")  # disabled
panel_7 = Panel(path_mapper)  # disabled

panel_8 = Panel(mshadow)  # disabled

runion = RegionUnion(Curves=path_mapper)  # disabled

# ---- group: Shadow
crv_2 = Curve(runion)  # disabled

# ----
# Matrix of Options
number_slider_12 = Slider(300, range=0..1000)  # disabled
number_slider_13 = Slider(5, range=0..10)  # disabled
number_slider_14 = Slider(4, range=0..10)  # disabled
sqgrid_2 = Square(Plane=PlaneXY(0, 0, 0), Size=number_slider_12, ExtentX=number_slider_14, ExtentY=number_slider_13)  # -> Cells, Points; disabled
group = Group(Objects=geo)  # disabled
pt_3 = Point(flatten(sqgrid_2.Points))  # disabled
geo_2 = Geometry(flatten(group))  # disabled
lng = ListLength(List=pt_3)  # disabled
lng_2 = ListLength(List=geo_2)  # disabled
crv_3 = Curve(flatten(crv_2))  # disabled
min = Minimum(A=lng, B=lng_2)  # disabled
split_4 = SplitList(List=geo_2, Index=min)  # -> ListA, ListB; disabled
split_5 = SplitList(List=crv_3, Index=min)  # -> ListA, ListB; disabled
split_6 = SplitList(List=pt_3, Index=min)  # -> ListA, ListB; disabled
move = Move(Geometry=split_5.ListA, Motion=split_6.ListA)  # -> Geometry, Transform; disabled
move_2 = Move(Geometry=split_4.ListA, Motion=split_6.ListA)  # -> Geometry, Transform; disabled

area_2 = Area(Geometry=crv_2)  # -> Area, Centroid; disabled
rint = RegionIntersection(CurvesA=crv_2, CurvesB=neighbor)  # disabled
rint_2 = RegionIntersection(CurvesA=crv_2, CurvesB=park)  # disabled
int_3 = Integer(area_2.Area)  # disabled
area_3 = Area(Geometry=rint_2)  # -> Area, Centroid; disabled
area_4 = Area(Geometry=rint)  # -> Area, Centroid; disabled

null = NullItem(Item=rint)  # -> NullFlags, InvalidFlags, Description; disabled
null_2 = NullItem(Item=rint_2)  # -> NullFlags, InvalidFlags, Description; disabled
panel_9 = Panel("0")  # disabled
# FIX!
panel_10 = Panel("0")  # disabled
weave = Weave(Pattern=null.NullFlags, Stream0=area_4.Area, Stream1=panel_10, NullGaps=False)  # disabled
weave_2 = Weave(Pattern=null_2.NullFlags, Stream0=area_3.Area, Stream1=panel_9, NullGaps=False)  # disabled

int_4 = Integer(weave_2)  # disabled
int_5 = Integer(weave)  # disabled

total_shadow_area = Panel(int_3)  # disabled
park_shadow = Panel(int_4)  # disabled
neighbor_shadow = Panel(int_5)  # disabled

# ----
# Text Labels
panel_11 = Panel("")  # disabled
panel_12 = Panel("test")  # disabled
merge_3 = Merge(Data1=simplify(int), Data2=simplify(int_3), Data3=simplify(int_4), Data4=simplify(int_5))  # disabled
panel_13 = Panel("""Floor Area: 
Shadow Area: 
Park Shadow: 
Neighbor Area: """)  # disabled
number_slider_15 = Slider(8, range=0..10)  # disabled
concat = Concatenate(FragmentA=panel_13, FragmentB=merge_3)  # disabled
join_2 = TextJoin(Text=concat, Join=panel_11)  # disabled
panel_14 = Panel(join_2)  # disabled
data = Data(flatten(join_2))  # disabled
split_7 = SplitList(List=data, Index=min)  # -> ListA, ListB; disabled
tag = TextTag3D(Location=split_6.ListA, Text=split_7.ListA, Size=number_slider_15, Justification=1)  # disabled
