# Grasshopper definition GenerativeDesign_WS_002G.gh (Grasshopper 1.0.7)
# plug-ins: Bifocals, MeshEdit Components

number_slider = Slider(30, range=0..100)
series = Series(Start=number_slider, Step=number_slider, Count=Slider(3, range=0..10))
# Parametric Model capable of taking multiple states
# 
# Way to evaluate different states fo model based on a given metric, i.e. areas
# 
# Basic Computational Analysis, browse, sort and filter (custom tool)
# 
# Use the workflow
# 
# Look at Evolutionary opperations
# Create a simple parametric model
number_slider_2 = Slider(23, range=0..100)
number_slider_3 = Slider(3, range=0..10)
floor_height = Slider(4.5, range=0..10)
crossref = CrossReference(
    ListA=series,
    ListB=series,
    ListC=series,
    ListD=series,
    ListE=series,
    ListF=series,
    ListG=series,
    ListH=series,
    CrossMode=1)  # -> ListA, ListB, ListC, ListD, ListE, ListF, ListG, ListH
merge = Merge(
    Data1=graft(crossref.ListA),
    Data2=graft(crossref.ListB),
    Data3=graft(crossref.ListC),
    Data4=graft(crossref.ListD),
    Data6=graft(crossref.ListE),
    Data7=graft(crossref.ListF),
    Data8=graft(crossref.ListG),
    Data9=graft(crossref.ListH))
sqgrid = Square(Plane=PlaneXY(0, 0, 0), Size=number_slider_2, ExtentX=number_slider_3, ExtentY=number_slider_3)  # -> Cells, Points
crv = Curve(flatten(sqgrid.Cells))

# ----
# Build a Sun System
# i.e. Ladybug
number_slider_4 = Slider(550, range=0..1000)
sph = Sphere(Base=PlaneXY(0, 0, 0), Radius=number_slider_4)
sec = BrepPlane(Brep=sph, Plane=PlaneXY(0, 0, 0))  # -> Curves, Points
srfsplit = SurfaceSplit(Surface=sph, Curves=sec.Curves)
split = SplitBrep(Brep=sph, Cutter=sec.Curves)
pt = ConstructPoint(XCoordinate=Slider(0.6, range=0..1), YCoordinate=Slider(0.87, range=0.5..1), ZCoordinate=0)
item = ListItem(List=srfsplit, Index=0, Wrap=True)
evalsrf = EvaluateSurface(Surface=reparameterize(item), Point=pt)  # -> Point, Normal, UDirection, VDirection, Frame
iso = IsoCurve(Surface=reparameterize(item), UVPoint=pt)  # -> UIsocurve, VIsocurve
pt_2 = Point(evalsrf.Point)
vec = Vector(evalsrf.Point)
rev = Reverse(Vector=vec)
amp = Amplitude(Vector=rev, Amplitude=Slider(287, range=0..1000))
vdisex = VectorDisplayEx(Point=pt_2, Vector=amp, Colour=ColourSwatch(SwatchColor=RGB(0, 255, 255)), Width=2)
vec_2 = Vector(amp)

sort = SortList(Keys=merge)  # -> reverse(Keys), ValuesA
split_2 = SplitList(List=merge, Index=Slider(4, range=0..10))  # -> ListA, ListB
item_2 = ListItem(List=sort.Keys, Index=0, Wrap=True)
merge_2 = Merge(Data1=simplify(split_2.ListA), Data2=simplify(item_2), Data3=simplify(split_2.ListB))
panel = Panel(merge_2)

# ----
# AREA FAST!!!
ma = MassAddition(Input=merge_2)  # -> Result, PartialResults
num = Number(number_slider_2)
multiplication = Multiplication(A=num, B=num, C=ma.Result)
int = Integer(multiplication)

viewer = ParamViewer(int)

# ----
# Really Nice and Smart
number_slider_5 = Slider(375942, range=0..1000000)
join = TextJoin(Text=merge_2, Join="-")
larger = LargerThan(FirstNumber=int, SecondNumber=number_slider_5)  # -> LargerThan, OrEqualTo
cull = CullPattern(List=join, CullPattern=larger.LargerThan)
panel_2 = Panel(larger.LargerThan)
split_3 = TextSplit(Text=cull, Separators="-")
clean = CleanTree(RemoveNulls=True, RemoveInvalid=True, RemoveEmpty=True, Tree=split_3)
heights = Integer(clean)
viewer_2 = ParamViewer(heights)

multiplication_2 = Multiplication(A=floor_height, B=heights)
Z = UnitZ(Factor=multiplication_2)  # disabled

# ----
# Fast Generating Mesh Model
int_2 = Integer(number_slider_2)
division = Division(A=int_2, B="2")
dom = ConstructDomain(DomainStart=expr("-x", division), DomainEnd=division)
area = Area(Geometry=crv)  # -> Area, Centroid
number_slider_6 = Slider(1, range=0..1)
box = DomainBox(Base=area.Centroid, X=dom, Y=dom, Z=multiplication_2)
mbox = MeshBox(Base=box, XCount=number_slider_6, YCount=number_slider_6, ZCount=number_slider_6)

# ----
# 3D Tower Nurbs
vec_3 = Vector(Z)
extr = Extrude(Base=crv, Direction=vec_3)
cap = CapHoles(Brep=extr)

floor_area = Panel(int)

panel_3 = Panel(join)

# ----
# Wickerson Studios Jazz
geo = Geometry(simplify(mbox))
pt_3 = ConstructPoint(XCoordinate=0, YCoordinate=0, ZCoordinate=0)
Y = UnitY(Factor=1)
X = UnitX(Factor=1)
flip = FlipMatrix(Data=geo)
volume = MeshVolume(Mesh=flip)  # -> Volume, Centroid
lng = ListLength(List=flip)
ln = Line(StartPoint=pt_3, EndPoint=volume.Centroid)
range = Range(Domain=Slider(1.11, range=0..2), Steps=expr("x-1", lng))
line = LineSDL(Start=pt_3, Direction=ln, Length=1)
pi = Pi(Factor=range)
rot3d = Rotate3D(Geometry=flip, Angle=pi, Center=volume.Centroid, Axis=line)  # -> Geometry, Transform
flip_2 = FlipMatrix(Data=rot3d.Geometry)

geo_2 = Geometry(flip_2)

# ----
# Shadow Analysis
mshadow = MeshShadow(Mesh=geo_2, Light=vec_2, Plane=PlaneXY(0, 0, 0))
neighbor = Curve(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)
park = Curve(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)

# ----
# Path Mapper Magic
# 
# Kind of like Partially Flattening
path_mapper = PathMapper(mshadow, source="{A;B;C;D}", target="{A;B;C}")
panel_5 = Panel(path_mapper)

panel_6 = Panel(mshadow)

runion = RegionUnion(Curves=path_mapper)

# ---- group: Shadow
crv_2 = Curve(runion)

# ----
# Matrix of Options
number_slider_7 = Slider(300, range=0..1000)
sqgrid_2 = Square(Plane=PlaneXY(0, 0, 0), Size=number_slider_7, ExtentX=Slider(4, range=0..10), ExtentY=Slider(5, range=0..10))  # -> Cells, Points
group = Group(Objects=geo_2)
pt_4 = Point(flatten(sqgrid_2.Points))
geo_3 = Geometry(flatten(group))
lng_2 = ListLength(List=pt_4)
lng_3 = ListLength(List=geo_3)
crv_3 = Curve(flatten(crv_2))
min = Minimum(A=lng_2, B=lng_3)
split_4 = SplitList(List=geo_3, Index=min)  # -> ListA, ListB
split_5 = SplitList(List=crv_3, Index=min)  # -> ListA, ListB
split_6 = SplitList(List=pt_4, Index=min)  # -> ListA, ListB
move = Move(Geometry=split_5.ListA, Motion=split_6.ListA)  # -> Geometry, Transform
move_2 = Move(Geometry=split_4.ListA, Motion=split_6.ListA)  # -> Geometry, Transform

area_2 = Area(Geometry=crv_2)  # -> Area, Centroid
rint = RegionIntersection(CurvesA=crv_2, CurvesB=neighbor)
rint_2 = RegionIntersection(CurvesA=crv_2, CurvesB=park)
int_3 = Integer(area_2.Area)
area_3 = Area(Geometry=rint_2)  # -> Area, Centroid
area_4 = Area(Geometry=rint)  # -> Area, Centroid

total_shadow_area = Panel(int_3)

# ----
# FIX!
null = NullItem(Item=rint)  # -> NullFlags, InvalidFlags, Description
null_2 = NullItem(Item=rint_2)  # -> NullFlags, InvalidFlags, Description
# FIX!
panel_7 = Panel("0")
weave = Weave(Pattern=null.NullFlags, Stream0=area_4.Area, Stream1=panel_7, NullGaps=False)
weave_2 = Weave(Pattern=null_2.NullFlags, Stream0=area_3.Area, Stream1="0", NullGaps=False)

int_4 = Integer(weave_2)
int_5 = Integer(weave)

park_shadow = Panel(int_4)
neighbor_shadow = Panel(int_5)

# ----
# Text Labels
panel_8 = Panel("")
panel_9 = Panel("test")
merge_3 = Merge(Data1=simplify(int), Data2=simplify(int_3), Data3=simplify(int_4), Data4=simplify(int_5))
panel_10 = Panel("""Floor Area: 
Shadow Area: 
Park Shadow: 
Neighbor Area: """)
concat = Concatenate(FragmentA=panel_10, FragmentB=merge_3)
join_2 = TextJoin(Text=concat, Join=panel_8)
panel_11 = Panel(join_2)
data = Data(flatten(join_2))
split_7 = SplitList(List=data, Index=min)  # -> ListA, ListB
tag = TextTag3D(Location=split_6.ListA, Text=split_7.ListA, Size=Slider(8, range=0..10), Justification=1)
