# Grasshopper definition GenerativeDesign_WS_003B.gh (Grasshopper 1.0.7)
# plug-ins: Bifocals, MeshEdit Components

number_slider = Slider(30, range=0..100)
series = Series(Start=number_slider, Step=number_slider, Count=Slider(3, range=0..10))
number_slider_2 = Slider(23, range=0..100)
number_slider_3 = Slider(3, range=0..10)
floor_height = Slider(4.5, range=0..10)
crossref = CrossReference(
    ListA=series,
    ListB=series,
    ListC=series,
    ListD=series,
    ListE=series,
    ListF=series,
    ListG=series,
    ListH=series,
    CrossMode=1)  # -> ListA, ListB, ListC, ListD, ListE, ListF, ListG, ListH
merge = Merge(
    Data1=graft(crossref.ListA),
    Data2=graft(crossref.ListB),
    Data3=graft(crossref.ListC),
    Data4=graft(crossref.ListD),
    Data6=graft(crossref.ListE),
    Data7=graft(crossref.ListF),
    Data8=graft(crossref.ListG),
    Data9=graft(crossref.ListH))
# Create a simple parametric model
# Create a simple parametric model
sqgrid = Square(Plane=PlaneXY(0, 0, 0), Size=number_slider_2, ExtentX=number_slider_3, ExtentY=number_slider_3)  # -> Cells, Points
crv = Curve(flatten(sqgrid.Cells))

# ----
# Build a Sun System
# i.e. Ladybug
number_slider_4 = Slider(550, range=0..1000)
sph = Sphere(Base=PlaneXY(0, 0, 0), Radius=number_slider_4)
sec = BrepPlane(Brep=sph, Plane=PlaneXY(0, 0, 0))  # -> Curves, Points
srfsplit = SurfaceSplit(Surface=sph, Curves=sec.Curves)
split = SplitBrep(Brep=sph, Cutter=sec.Curves)
pt = ConstructPoint(XCoordinate=Slider(0.6, range=0..1), YCoordinate=Slider(0.87, range=0.5..1), ZCoordinate=0)
item = ListItem(List=srfsplit, Index=0, Wrap=True)
evalsrf = EvaluateSurface(Surface=reparameterize(item), Point=pt)  # -> Point, Normal, UDirection, VDirection, Frame
iso = IsoCurve(Surface=reparameterize(item), UVPoint=pt)  # -> UIsocurve, VIsocurve
pt_2 = Point(evalsrf.Point)
vec = Vector(evalsrf.Point)
rev = Reverse(Vector=vec)
amp = Amplitude(Vector=rev, Amplitude=Slider(287, range=0..1000))
vdisex = VectorDisplayEx(Point=pt_2, Vector=amp, Colour=ColourSwatch(SwatchColor=RGB(0, 255, 255)), Width=2)
vec_2 = Vector(amp)

number_slider_5 = Slider(30, range=0..100)  # disabled
number_slider_6 = Slider(3, range=0..10)  # disabled
sqgrid_2 = Square(Plane=PlaneXY(0, 0, 0), Size=Slider(300, range=0..1000), ExtentX=Slider(4, range=0..10), ExtentY=Slider(5, range=0..10))  # -> Cells, Points
pt_3 = Point(flatten(sqgrid_2.Points))
series_2 = Series(Start=number_slider_5, Step=number_slider_5, Count=number_slider_6)  # disabled
panel = Panel("test")
# Parametric Model capable of taking multiple states
# 
# Way to evaluate different states fo model based on a given metric, i.e. areas
# 
# Basic Computational Analysis, browse, sort and filter (custom tool)
# 
# Use the workflow
# 
# Look at Evolutionary opperations
# Create a simple parametric model
number_slider_7 = Slider(23, range=0..100)  # disabled
number_slider_8 = Slider(3, range=0..10)  # disabled
panel_2 = Panel("""Floor Area: 
Shadow Area: 
Park Shadow: 
Neighbor Area: """)
floor_height_2 = Slider(4.5, range=0..10)  # disabled
lng = ListLength(List=pt_3)
crossref_2 = CrossReference(
    ListA=series_2,
    ListB=series_2,
    ListC=series_2,
    ListD=series_2,
    ListE=series_2,
    ListF=series_2,
    ListG=series_2,
    ListH=series_2,
    CrossMode=1)  # -> ListA, ListB, ListC, ListD, ListE, ListF, ListG, ListH; disabled
merge_2 = Merge(
    Data1=graft(crossref_2.ListA),
    Data2=graft(crossref_2.ListB),
    Data3=graft(crossref_2.ListC),
    Data4=graft(crossref_2.ListD),
    Data6=graft(crossref_2.ListE),
    Data7=graft(crossref_2.ListF),
    Data8=graft(crossref_2.ListG),
    Data9=graft(crossref_2.ListH))  # disabled
sqgrid_3 = Square(Plane=PlaneXY(0, 0, 0), Size=number_slider_7, ExtentX=number_slider_8, ExtentY=number_slider_8)  # -> Cells, Points; disabled
crv_2 = Curve(flatten(sqgrid_3.Cells))  # disabled

# ----
# Build a Sun System
# i.e. Ladybug
number_slider_9 = Slider(550, range=0..1000)  # disabled
number_slider_10 = Slider(0.6, range=0..1)  # disabled
number_slider_11 = Slider(0.87, range=0.5..1)  # disabled
sph_2 = Sphere(Base=PlaneXY(0, 0, 0), Radius=number_slider_9)  # disabled
sec_2 = BrepPlane(Brep=sph_2, Plane=PlaneXY(0, 0, 0))  # -> Curves, Points; disabled
srfsplit_2 = SurfaceSplit(Surface=sph_2, Curves=sec_2.Curves)  # disabled
split_2 = SplitBrep(Brep=sph_2, Cutter=sec_2.Curves)  # disabled
pt_4 = ConstructPoint(XCoordinate=number_slider_10, YCoordinate=number_slider_11, ZCoordinate=0)  # disabled
item_2 = ListItem(List=srfsplit_2, Index=0, Wrap=True)  # disabled
evalsrf_2 = EvaluateSurface(Surface=reparameterize(item_2), Point=pt_4)  # -> Point, Normal, UDirection, VDirection, Frame; disabled
iso_2 = IsoCurve(Surface=reparameterize(item_2), UVPoint=pt_4)  # -> UIsocurve, VIsocurve; disabled
number_slider_12 = Slider(287, range=0..1000)  # disabled
pt_5 = Point(evalsrf_2.Point)  # disabled
vec_3 = Vector(evalsrf_2.Point)  # disabled
rev_2 = Reverse(Vector=vec_3)  # disabled
swatch = ColourSwatch(SwatchColor=RGB(0, 255, 255))  # disabled
amp_2 = Amplitude(Vector=rev_2, Amplitude=number_slider_12)  # disabled
vdisex_2 = VectorDisplayEx(Point=pt_5, Vector=amp_2, Colour=swatch, Width=2)  # disabled
vec_4 = Vector(amp_2)  # disabled

sort = SortList(Keys=merge)  # -> reverse(Keys), ValuesA
split_3 = SplitList(List=merge, Index=Slider(4, range=0..10))  # -> ListA, ListB
item_3 = ListItem(List=sort.Keys, Index=0, Wrap=True)
merge_3 = Merge(Data1=simplify(split_3.ListA), Data2=simplify(item_3), Data3=simplify(split_3.ListB))
panel_3 = Panel(merge_3)

# ----
# AREA FAST!!!
ma = MassAddition(Input=merge_3)  # -> Result, PartialResults
num = Number(number_slider_2)
multiplication = Multiplication(A=num, B=num, C=ma.Result)
# AREA FAST!!!
int = Integer(multiplication)

viewer = ParamViewer(int)

# ----
# Really Nice and Smart
number_slider_13 = Slider(357489, range=0..1000000)
join = TextJoin(Text=merge_3, Join="-")
# Really Nice and Smart
# Really Nice and Smart
larger = LargerThan(FirstNumber=int, SecondNumber=number_slider_13)  # -> LargerThan, OrEqualTo
cull = CullPattern(List=join, CullPattern=larger.LargerThan)
panel_4 = Panel(larger.LargerThan)
split_4 = TextSplit(Text=cull, Separators="-")
clean = CleanTree(RemoveNulls=True, RemoveInvalid=True, RemoveEmpty=True, Tree=split_4)
heights = Integer(clean)
viewer_2 = ParamViewer(heights)

multiplication_2 = Multiplication(A=floor_height, B=heights)
Z = UnitZ(Factor=multiplication_2)

# ----
# Fast Generating Mesh Model
int_2 = Integer(number_slider_2)
division = Division(A=int_2, B="2")
area = Area(Geometry=crv)  # -> Area, Centroid
dom = ConstructDomain(DomainStart=expr("-x", division), DomainEnd=division)
# Fast Generating Mesh Model
# Fast Generating Mesh Model
number_slider_14 = Slider(1, range=0..1)
# 3D Tower Nurbs
# 3D Tower Nurbs
box = DomainBox(Base=area.Centroid, X=dom, Y=dom, Z=multiplication_2)
mbox = MeshBox(Base=box, XCount=number_slider_14, YCount=number_slider_14, ZCount=number_slider_14)

# ----
# 3D Tower Nurbs
vec_5 = Vector(Z)
extr = Extrude(Base=crv, Direction=vec_5)
cap = CapHoles(Brep=extr)

floor_area = Panel(int)

panel_5 = Panel(join)

geo = Geometry(mbox)
group = Group(Objects=geo)
geo_2 = Geometry(flatten(group))
lng_2 = ListLength(List=geo_2)
min = Minimum(A=lng, B=lng_2)
split_5 = SplitList(List=geo_2, Index=min)  # -> ListA, ListB
split_6 = SplitList(List=pt_3, Index=min)  # -> ListA, ListB
move = Move(Geometry=split_5.ListA, Motion=split_6.ListA)  # -> Geometry, Transform

# ----
# Shadow Analysis
mshadow = MeshShadow(Mesh=geo, Light=vec_2, Plane=PlaneXY(0, 0, 0))
neighbor = Curve(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)
park = Curve(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)

panel_7 = Panel(mshadow)

# ----
# Path Mapper Magic
# 
# Kind of like Partially Flattening
path_mapper = PathMapper(mshadow, source="{A;B;C;D}", target="{A;B;C}")
panel_8 = Panel(path_mapper)

runion = RegionUnion(Curves=path_mapper)

# ---- group: Shadow
crv_3 = Curve(runion)

# ----
crv_4 = Curve(flatten(crv_3))
split_7 = SplitList(List=crv_4, Index=min)  # -> ListA, ListB
move_2 = Move(Geometry=split_7.ListA, Motion=split_6.ListA)  # -> Geometry, Transform

area_2 = Area(Geometry=crv_3)  # -> Area, Centroid
rint = RegionIntersection(CurvesA=crv_3, CurvesB=neighbor)
rint_2 = RegionIntersection(CurvesA=crv_3, CurvesB=park)
int_3 = Integer(area_2.Area)
area_3 = Area(Geometry=rint_2)  # -> Area, Centroid
area_4 = Area(Geometry=rint)  # -> Area, Centroid

total_shadow_area = Panel(int_3)

null = NullItem(Item=rint)  # -> NullFlags, InvalidFlags, Description
null_2 = NullItem(Item=rint_2)  # -> NullFlags, InvalidFlags, Description
weave = Weave(Pattern=null.NullFlags, Stream0=area_4.Area, Stream1="0", NullGaps=False)
weave_2 = Weave(Pattern=null_2.NullFlags, Stream0=area_3.Area, Stream1="0", NullGaps=False)

int_4 = Integer(weave_2)
int_5 = Integer(weave)

park_shadow = Panel(int_4)
neighbor_shadow = Panel(int_5)
merge_4 = Merge(Data1=simplify(int), Data2=simplify(int_3), Data3=simplify(int_4), Data4=simplify(int_5))
concat = Concatenate(FragmentA=panel_2, FragmentB=merge_4)
join_2 = TextJoin(Text=concat)
panel_9 = Panel(join_2)
data = Data(flatten(join_2))
split_8 = SplitList(List=data, Index=min)  # -> ListA, ListB
tag = TextTag3D(Location=split_6.ListA, Text=split_8.ListA, Size=Slider(8, range=0..10), Justification=1)

number_slider_15 = Slider(4, range=0..10)  # disabled
sort_2 = SortList(Keys=merge_2)  # -> reverse(Keys), ValuesA; disabled
split_9 = SplitList(List=merge_2, Index=number_slider_15)  # -> ListA, ListB; disabled
item_4 = ListItem(List=sort_2.Keys, Index=0, Wrap=True)  # disabled
merge_5 = Merge(Data1=simplify(split_9.ListA), Data2=simplify(item_4), Data3=simplify(split_9.ListB))  # disabled
panel_10 = Panel(merge_5)  # disabled

# ----
# AREA FAST!!!
ma_2 = MassAddition(Input=merge_5)  # -> Result, PartialResults; disabled
num_2 = Number(number_slider_7)  # disabled
multiplication_3 = Multiplication(A=num_2, B=num_2, C=ma_2.Result)  # disabled
int_6 = Integer(multiplication_3)  # disabled

viewer_3 = ParamViewer(int_6)  # disabled

# ----
# Really Nice and Smart
number_slider_16 = Slider(375942, range=0..1000000)  # disabled
panel_11 = Panel("-")  # disabled
join_3 = TextJoin(Text=merge_5, Join=panel_11)  # disabled
larger_2 = LargerThan(FirstNumber=int_6, SecondNumber=number_slider_16)  # -> LargerThan, OrEqualTo; disabled
cull_2 = CullPattern(List=join_3, CullPattern=larger_2.LargerThan)  # disabled
panel_12 = Panel(larger_2.LargerThan)  # disabled
split_10 = TextSplit(Text=cull_2, Separators=panel_11)  # disabled
clean_2 = CleanTree(RemoveNulls=True, RemoveInvalid=True, RemoveEmpty=True, Tree=split_10)  # disabled
heights_2 = Integer(clean_2)  # disabled
viewer_4 = ParamViewer(heights_2)  # disabled

multiplication_4 = Multiplication(A=floor_height_2, B=heights_2)  # disabled
Z_2 = UnitZ(Factor=multiplication_4)  # disabled

# ----
# Fast Generating Mesh Model
int_7 = Integer(number_slider_7)  # disabled
panel_13 = Panel("2")  # disabled
division_2 = Division(A=int_7, B=panel_13)  # disabled
dom_2 = ConstructDomain(DomainStart=expr("-x", division_2), DomainEnd=division_2)  # disabled
area_5 = Area(Geometry=crv_2)  # -> Area, Centroid; disabled
number_slider_17 = Slider(1, range=0..1)  # disabled
box_2 = DomainBox(Base=area_5.Centroid, X=dom_2, Y=dom_2, Z=multiplication_4)  # disabled
mbox_2 = MeshBox(Base=box_2, XCount=number_slider_17, YCount=number_slider_17, ZCount=number_slider_17)  # disabled

# ----
# 3D Tower Nurbs
vec_6 = Vector(Z_2)  # disabled
extr_2 = Extrude(Base=crv_2, Direction=vec_6)  # disabled
cap_2 = CapHoles(Brep=extr_2)  # disabled

floor_area_2 = Panel(int_6)  # disabled

panel_14 = Panel(join_3)  # disabled

# ----
# Wickerson Studios Jazz
geo_3 = Geometry(simplify(mbox_2))  # disabled
number_slider_18 = Slider(1.11, range=0..2)  # disabled
pt_6 = ConstructPoint(XCoordinate=0, YCoordinate=0, ZCoordinate=0)  # disabled
Y = UnitY(Factor=1)  # disabled
X = UnitX(Factor=1)  # disabled
flip = FlipMatrix(Data=geo_3)  # disabled
volume = MeshVolume(Mesh=flip)  # -> Volume, Centroid; disabled
lng_3 = ListLength(List=flip)  # disabled
ln = Line(StartPoint=pt_6, EndPoint=volume.Centroid)  # disabled
range = Range(Domain=number_slider_18, Steps=expr("x-1", lng_3))  # disabled
line = LineSDL(Start=pt_6, Direction=ln, Length=1)  # disabled
pi = Pi(Factor=range)  # disabled
rot3d = Rotate3D(Geometry=flip, Angle=pi, Center=volume.Centroid, Axis=line)  # -> Geometry, Transform; disabled
flip_2 = FlipMatrix(Data=rot3d.Geometry)  # disabled

geo_4 = Geometry(flip_2)  # disabled

# ----
# Shadow Analysis
mshadow_2 = MeshShadow(Mesh=geo_4, Light=vec_4, Plane=PlaneXY(0, 0, 0))  # disabled
neighbor_2 = Curve(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)  # disabled
park_2 = Curve(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)  # disabled

# ----
# Path Mapper Magic
# 
# Kind of like Partially Flattening
path_mapper_2 = PathMapper(mshadow_2, source="{A;B;C;D}", target="{A;B;C}")  # disabled
panel_16 = Panel(path_mapper_2)  # disabled

panel_17 = Panel(mshadow_2)  # disabled

runion_2 = RegionUnion(Curves=path_mapper_2)  # disabled

# ---- group: Shadow
crv_5 = Curve(runion_2)  # disabled

# ----
# Matrix of Options
number_slider_19 = Slider(300, range=0..1000)  # disabled
number_slider_20 = Slider(5, range=0..10)  # disabled
number_slider_21 = Slider(4, range=0..10)  # disabled
sqgrid_4 = Square(Plane=PlaneXY(0, 0, 0), Size=number_slider_19, ExtentX=number_slider_21, ExtentY=number_slider_20)  # -> Cells, Points; disabled
group_2 = Group(Objects=geo_4)  # disabled
pt_7 = Point(flatten(sqgrid_4.Points))  # disabled
geo_5 = Geometry(flatten(group_2))  # disabled
lng_4 = ListLength(List=pt_7)  # disabled
lng_5 = ListLength(List=geo_5)  # disabled
crv_6 = Curve(flatten(crv_5))  # disabled
min_2 = Minimum(A=lng_4, B=lng_5)  # disabled
split_11 = SplitList(List=geo_5, Index=min_2)  # -> ListA, ListB; disabled
split_12 = SplitList(List=crv_6, Index=min_2)  # -> ListA, ListB; disabled
split_13 = SplitList(List=pt_7, Index=min_2)  # -> ListA, ListB; disabled
move_3 = Move(Geometry=split_12.ListA, Motion=split_13.ListA)  # -> Geometry, Transform; disabled
move_4 = Move(Geometry=split_11.ListA, Motion=split_13.ListA)  # -> Geometry, Transform; disabled

area_6 = Area(Geometry=crv_5)  # -> Area, Centroid; disabled
rint_3 = RegionIntersection(CurvesA=crv_5, CurvesB=neighbor_2)  # disabled
rint_4 = RegionIntersection(CurvesA=crv_5, CurvesB=park_2)  # disabled
int_8 = Integer(area_6.Area)  # disabled
area_7 = Area(Geometry=rint_4)  # -> Area, Centroid; disabled
area_8 = Area(Geometry=rint_3)  # -> Area, Centroid; disabled

total_shadow_area_2 = Panel(int_8)  # disabled

# ----
# FIX!
null_3 = NullItem(Item=rint_3)  # -> NullFlags, InvalidFlags, Description; disabled
null_4 = NullItem(Item=rint_4)  # -> NullFlags, InvalidFlags, Description; disabled
panel_18 = Panel("0")  # disabled
panel_19 = Panel("0")  # disabled
weave_3 = Weave(Pattern=null_3.NullFlags, Stream0=area_8.Area, Stream1=panel_18, NullGaps=False)  # disabled
weave_4 = Weave(Pattern=null_4.NullFlags, Stream0=area_7.Area, Stream1=panel_19, NullGaps=False)  # disabled

int_9 = Integer(weave_4)  # disabled
int_10 = Integer(weave_3)  # disabled

park_shadow_2 = Panel(int_9)  # disabled
neighbor_shadow_2 = Panel(int_10)  # disabled

# ----
# Text Labels
panel_20 = Panel("")  # disabled
panel_21 = Panel("test")  # disabled
merge_6 = Merge(Data1=simplify(int_6), Data2=simplify(int_8), Data3=simplify(int_9), Data4=simplify(int_10))  # disabled
panel_22 = Panel("""Floor Area: 
Shadow Area: 
Park Shadow: 
Neighbor Area: """)  # disabled
number_slider_22 = Slider(8, range=0..10)  # disabled
concat_2 = Concatenate(FragmentA=panel_22, FragmentB=merge_6)  # disabled
join_4 = TextJoin(Text=concat_2, Join=panel_20)  # disabled
panel_23 = Panel(join_4)  # disabled
data_2 = Data(flatten(join_4))  # disabled
split_14 = SplitList(List=data_2, Index=min_2)  # -> ListA, ListB; disabled
tag_2 = TextTag3D(Location=split_13.ListA, Text=split_14.ListA, Size=number_slider_22, Justification=1)  # disabled
